# Grasshopper definition Proof of concept.ghx (Grasshopper 1.0.7)

# INSTRUCTION: This script generates the basic prototype of a house - some of its features are decided on by you, the others are random.
# 
# To start, in the input text describe the basic characteristics of the house that you want.
# 
# 
# 
# - start the description with the word "Generate"
# 
# - the description must contain the words "house" and "bedrooms"
# 
# - if you want a specific number of bedrooms, write a number between 2 and 5, followed by the word "bedrooms"
# 
# - if you don't enter the number of bedrooms, the script will pick a random number between 2 and 5 for you
# 
# - if you don't enter a whole number, the script will pick a random number for you
# Example text 1: Generate a house with a few bedrooms
# Example text 2: Generate a house with 3 bedrooms
# Example text 3: Generate a big, modern house for a family of 3, with 4 bedrooms
input_text = Panel("")
# HOW IT WORKS: The principles of creating a house
# 
# The principles were created on the basis of an analysis of the examples provided by Archon's catalogue houses. It turned out that one of the major principles of these houses was that the floor plan almost always contains a corridor that starts in the middle of the shorter side of the house and spans most of the length of the house. At the end of the corridor there is a living room/living room with a dining area. The other rooms are located on both sides of the corridor.
# 
# 
# 
# At this stage, the script is not very complicated and takes into consideration only the number of bedrooms that one would want, assigning random values within the given range to the other elements (e.g. the building footprint or room areas). In the final product, which is not the case now, the script would be further developed by adding additional criteria (similar to those used by Archon), such as: the number of floors, the type of roof, an additional basement, an additional garage, etc. The script can also be developed by adding criteria that are absent in Archon projects, such as the optimal building proportions adjusted to the given plot (based on data acquired from connected QGIS software), optimal building orientation and window layout (based on data acquired from simulations with Ladybug), or custom room adjacencies (e.g. the living room with a direct access to the kitchen), etc.
# 
# 
# DISCLAIMER
# *This prototype is not an AI of any sort, but rather a demonstration of how the user might interact with this type of program (but with integrated AI).
ghpython_script = GhPythonScript(text=input_text)  # -> out, Footprint_geometry, Footprint_info, Corridor_geometry, Corridor_info, Living_geometry, Living_info, Kitchen_geometry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
# ---------- ghpython_script: Python ----------
__author__ = "david drozdz"
__version__ = "1.0"


#Import
import rhinoscriptsyntax as rs
import Rhino.Geometry as rg
import random
import math



#Creating rooms
def createRoom(x, y, w, h):
  return [
    [ x, y ],
    [ x, y + h ],
    [ x + w, y + h],
    [ x + w, y]
  ]



#Rounding numbers up
def round_num_up(n, decimals=0):
    multiplier = 10 ** decimals
    return math.floor(n*multiplier + 0.5) / multiplier



#Checking if text starts with "Generate" and contains "house"
if text.startswith("Generate") and "house" in text:
    
  #Spliting text into a list of words
  words = text.split()

  #Checking if there is a word "bedrooms" in text
  if "bedrooms" in text:

    #Finding the index of the word "bedrooms"
    index = words.index("bedrooms")

    #Checking if the word before "bedrooms" is a number
    if words[index-1].isdigit():

      #Converting the number to a float
      bedrooms = float(words[index-1])

      #Checking if the number of "bedrooms" is smaller than 2
      if bedrooms < 2:
        out4 = "Not enough bedrooms to create a house."
        print(out4)

      #Checking if the number of "bedrooms" is bigger than 5
      elif bedrooms > 5:
        out5 = "Too many bedrooms to create a house."
        print(out5)



      ########################################
      #Checking if the number of bedrooms is 2
      elif bedrooms == 2:
        out6 = "So you want a house with 2 bedrooms? Well, okay then."
        print(out6)

        #Creating plane for rooms
        origin = rg.Point3d(0,0,0)
        x_axis = rg.Vector3d(1,0,0)
        y_axis = rg.Vector3d(0,1,0)
        plane = rg.Plane(origin, x_axis, y_axis)

        #Creating a footprint with random area between 60 and 80 and random proporortions of sides between 1:1.2 and 1:2
        Footprint_area = random.uniform(60, 80)
        Footprint_aspect = random.uniform(1.2, 2)
        Footprint_w = math.sqrt(Footprint_area / Footprint_aspect)
        Footprint_h = Footprint_w * Footprint_aspect
        Footprint_create = createRoom(0,0, Footprint_w, Footprint_h)
        Footprint_p1 = rg.Point3d(0,0,0)
        Footprint_p2 = rg.Point3d(0,Footprint_w,0)
        Footprint_p3 = rg.Point3d(Footprint_h,Footprint_w,0)
        Footprint_p4 = rg.Point3d(Footprint_h,0,0)
        Footprint_geometry = rg.Rectangle3d(plane, Footprint_p1, Footprint_p3)

        #Extracting Footprint info
        Footprint_area_round = round_num_up(Footprint_area, decimals = 2)
        Footprint_info = "Area: " + str(Footprint_area_round) + " m2"

        #Creating Corridor in the center of the footprint, tangent to all rooms with 1,2m width
        offset = 0.6
        Corridor_h = random.uniform((Footprint_h - 4) / Footprint_h, (Footprint_h - 3) / Footprint_h)
        Corridor_p1 = rg.Point3d(0,Footprint_w / 2 - offset,0)
        Corridor_p2 = rg.Point3d(Footprint_h * Corridor_h,Footprint_w / 2 - offset,0)
        Corridor_p3 = rg.Point3d(Footprint_h * Corridor_h,Footprint_w / 2 + offset,0)
        Corridor_p4 = rg.Point3d(0,Footprint_w / 2 + offset,0)
        Corridor_geometry = rg.Rectangle3d(plane, Corridor_p1, Corridor_p3)

        #Extracting Corridor info
        Corridor_area = 1.2 * Footprint_h * Corridor_h
        Corridor_area_round = round_num_up(Corridor_area, decimals = 2)
        Corridor_info = "Area: " + str(Corridor_area_round) + " m2"

        #Creating Living room as the biggest room at the end of the corridor
        Corridor_h_rest = 1 - Corridor_h
        Living_create = createRoom(0, Footprint_h * Corridor_h, Footprint_w, Footprint_h * Corridor_h_rest)
        Living_p1 = rg.Point3d(Footprint_h * Corridor_h,0,0)
        Living_p2 = rg.Point3d(Footprint_h,0,0)
        Living_p3 = rg.Point3d(Footprint_h,Footprint_w,0)
        Living_p4 = rg.Point3d(Footprint_h * Corridor_h,Footprint_w,0)
        Living_geometry = rg.Rectangle3d(plane, Living_p1, Living_p3)

        #Extracting Living room info
        Living_area = Footprint_w * Footprint_h * Corridor_h_rest
        Living_area_round = round_num_up(Living_area, decimals = 2)
        Living_info = "Area: " + str(Living_area_round) + " m2"

        #Creating 2 rooms on side 1 of the corridor with min area 6
        Corridor_rooms_1_min_area = 6
        Corridor_rooms_1_w = Footprint_w - (Footprint_w / 2 + offset)
        Corridor_rooms_1_h = Footprint_h * Corridor_h
        Corridor_rooms_1_area = Corridor_rooms_1_w * Corridor_rooms_1_h
        Corridor_room_1_1_area = random.uniform(Corridor_rooms_1_min_area, Corridor_rooms_1_area - Corridor_rooms_1_min_area)
        Corridor_room_1_2_area = Corridor_rooms_1_area - Corridor_room_1_1_area
        Corridor_room_1_1_h = Corridor_room_1_1_area / Corridor_rooms_1_w
        Corridor_room_1_2_h = Corridor_room_1_2_area / Corridor_rooms_1_w

        #Side 1 - room 1
        Corridor_room_1_1 = createRoom(Footprint_w / 2 + offset, 0, Corridor_rooms_1_w, Corridor_room_1_1_h)
        Corridor_room_1_1_p1 = rg.Point3d(0,Footprint_w / 2 + offset,0)
        Corridor_room_1_1_p2 = rg.Point3d(Corridor_room_1_1_h,Footprint_w / 2 + offset,0)
        Corridor_room_1_1_p3 = rg.Point3d(Corridor_room_1_1_h,Footprint_w,0)
        Corridor_room_1_1_p4 = rg.Point3d(0,Footprint_w,0)
        Bathroom1_geometry = rg.Rectangle3d(plane, Corridor_room_1_1_p1, Corridor_room_1_1_p3)

        #Extracting Side 1 - room 1 info
        Corridor_room_1_1_area_round = round_num_up(Corridor_room_1_1_area, decimals = 2)
        Bathroom1_info = "Area: " + str(Corridor_room_1_1_area_round) + " m2"

        #Side 1 - room 2
        Corridor_room_1_2_h = createRoom(Footprint_w / 2 + offset, Corridor_room_1_1_h, Corridor_rooms_1_w, Corridor_room_1_2_h)
        Corridor_room_1_2_p1 = rg.Point3d(Corridor_room_1_1_h,Footprint_w / 2 + offset,0)
        Corridor_room_1_2_p2 = rg.Point3d(Footprint_h * Corridor_h,Footprint_w / 2 + offset,0)
        Corridor_room_1_2_p3 = rg.Point3d(Footprint_h * Corridor_h,Footprint_w,0)
        Corridor_room_1_2_p4 = rg.Point3d(Corridor_room_1_1_h,Footprint_w,0)
        Kitchen_geometry = rg.Rectangle3d(plane, Corridor_room_1_2_p1, Corridor_room_1_2_p3)

        #Extracting Side 1 - room 2 info
        Corridor_room_1_2_area_round = round_num_up(Corridor_room_1_2_area, decimals = 2)
        Kitchen_info = "Area: " + str(Corridor_room_1_2_area_round) + " m2"

        #Creating 2 rooms on side 2 of the corridor with min area 8
        Corridor_rooms_2_min_area = 8
        Corridor_rooms_2_w = 0 + (Footprint_w / 2 - offset)
        Corridor_rooms_2_h = Footprint_h * Corridor_h
        Corridor_rooms_2_area = Corridor_rooms_2_w * Corridor_rooms_2_h
        Corridor_room_2_1_area = random.uniform(Corridor_rooms_2_min_area, Corridor_rooms_2_area - Corridor_rooms_2_min_area)
        Corridor_room_2_2_area = Corridor_rooms_2_area - Corridor_room_2_1_area
        Corridor_room_2_1_h = Corridor_room_2_1_area / Corridor_rooms_2_w
        Corridor_room_2_2_h = Corridor_room_2_2_area / Corridor_rooms_2_w

        #Side 2 - room 1
        Corridor_room_2_1 = createRoom(Footprint_w / 2 - offset, 0, Corridor_rooms_2_w, Corridor_room_2_1_h)
        Corridor_room_2_1_p1 = rg.Point3d(0,0,0)
        Corridor_room_2_1_p2 = rg.Point3d(Corridor_room_2_1_h,0,0)
        Corridor_room_2_1_p3 = rg.Point3d(Corridor_room_2_1_h,Corridor_rooms_2_w,0)
        Corridor_room_2_1_p4 = rg.Point3d(0,Corridor_rooms_2_w,0)
        Bedroom1_geometry = rg.Rectangle3d(plane, Corridor_room_2_1_p1, Corridor_room_2_1_p3)

        #Extracting Side 2 - room 1 info
        Corridor_room_2_1_area_round = round_num_up(Corridor_room_2_1_area, decimals = 2)
        Bedroom1_info = "Area: " + str(Corridor_room_2_1_area_round) + " m2"

        #Side 2 - room 2
        Corridor_room_2_2_h = createRoom(Footprint_w / 2 - offset, Corridor_room_2_2_h, Corridor_rooms_2_w, Corridor_room_2_2_h)
        Corridor_room_2_2_p1 = rg.Point3d(Corridor_room_2_1_h,0,0)
        Corridor_room_2_2_p2 = rg.Point3d(Footprint_h * Corridor_h,0,0)
        Corridor_room_2_2_p3 = rg.Point3d(Footprint_h * Corridor_h,Footprint_w / 2 - offset,0)
        Corridor_room_2_2_p4 = rg.Point3d(Corridor_room_2_1_h,Footprint_w / 2 - offset,0)
        Bedroom2_geometry = rg.Rectangle3d(plane, Corridor_room_2_2_p1, Corridor_room_2_2_p3)

        #Extracting Side 2 - room 2 info
        Corridor_room_2_2_area_round = round_num_up(Corridor_room_2_2_area, decimals = 2)
        Bedroom2_info = "Area: " + str(Corridor_room_2_2_area_round) + " m2"



      ########################################
      #Checking if the number of bedrooms is 3
      elif bedrooms == 3:
        out7 = "So you want a house with 3 bedrooms? Well, okay then."
        print(out7)

        #Creating plane for rooms
        origin = rg.Point3d(0,0,0)
        x_axis = rg.Vector3d(1,0,0)
        y_axis = rg.Vector3d(0,1,0)
        plane = rg.Plane(origin, x_axis, y_axis)

        #Creating a footprint with random area between 85 and 100 and random proporortions of sides between 1:1.5 and 1:2.25
        Footprint_area = random.uniform(85, 100)
        Footprint_aspect = random.uniform(1.5, 2.25)
        Footprint_w = math.sqrt(Footprint_area / Footprint_aspect)
        Footprint_h = Footprint_w * Footprint_aspect
        Footprint_create = createRoom(0,0, Footprint_w, Footprint_h)
        Footprint_p1 = rg.Point3d(0,0,0)
        Footprint_p2 = rg.Point3d(0,Footprint_w,0)
        Footprint_p3 = rg.Point3d(Footprint_h,Footprint_w,0)
        Footprint_p4 = rg.Point3d(Footprint_h,0,0)
        Footprint_geometry = rg.Rectangle3d(plane, Footprint_p1, Footprint_p3)

        #Extracting Footprint info
        Footprint_area_round = round_num_up(Footprint_area, decimals = 2)
        Footprint_info = "Area: " + str(Footprint_area_round) + " m2"

        #Creating Corridor in the center of the footprint, tangent to all rooms with 1,2m width
        offset = 0.6
        Corridor_h = random.uniform((Footprint_h - 4) / Footprint_h, (Footprint_h - 3) / Footprint_h)
        Corridor_p1 = rg.Point3d(0,Footprint_w / 2 - offset,0)
        Corridor_p2 = rg.Point3d(Footprint_h * Corridor_h,Footprint_w / 2 - offset,0)
        Corridor_p3 = rg.Point3d(Footprint_h * Corridor_h,Footprint_w / 2 + offset,0)
        Corridor_p4 = rg.Point3d(0,Footprint_w / 2 + offset,0)
        Corridor_geometry = rg.Rectangle3d(plane, Corridor_p1, Corridor_p3)

        #Extracting Corridor info
        Corridor_area = 1.2 * Footprint_h * Corridor_h
        Corridor_area_round = round_num_up(Corridor_area, decimals = 2)
        Corridor_info = "Area: " + str(Corridor_area_round) + " m2"

        #Creating Living room as the biggest room at the end of the corridor
        Corridor_h_rest = 1 - Corridor_h
        Living_create = createRoom(0, Footprint_h * Corridor_h, Footprint_w, Footprint_h * Corridor_h_rest)
        Living_p1 = rg.Point3d(Footprint_h * Corridor_h,0,0)
        Living_p2 = rg.Point3d(Footprint_h,0,0)
        Living_p3 = rg.Point3d(Footprint_h,Footprint_w,0)
        Living_p4 = rg.Point3d(Footprint_h * Corridor_h,Footprint_w,0)
        Living_geometry = rg.Rectangle3d(plane, Living_p1, Living_p3)

        #Extracting Living room info
        Living_area = Footprint_w * Footprint_h * Corridor_h_rest
        Living_area_round = round_num_up(Living_area, decimals = 2)
        Living_info = "Area: " + str(Living_area_round) + " m2"

        #Creating 3 rooms on side 1 of the corridor with min area 8
        Corridor_rooms_1_min_area = 8
        Corridor_rooms_1_w = Footprint_w - (Footprint_w / 2 + offset)
        Corridor_rooms_1_h = Footprint_h * Corridor_h
        Corridor_rooms_1_area = Corridor_rooms_1_w * Corridor_rooms_1_h
        Corridor_room_1_1_area = random.uniform(Corridor_rooms_1_min_area, Corridor_rooms_1_area - (Corridor_rooms_1_min_area * 2))
        Corridor_room_1_2_area = random.uniform(Corridor_rooms_1_min_area, Corridor_rooms_1_area - Corridor_room_1_1_area - Corridor_rooms_1_min_area)
        Corridor_room_1_3_area = Corridor_rooms_1_area - Corridor_room_1_1_area - Corridor_room_1_2_area
        Corridor_room_1_1_h = Corridor_room_1_1_area / Corridor_rooms_1_w
        Corridor_room_1_2_h = Corridor_room_1_2_area / Corridor_rooms_1_w
        Corridor_room_1_3_h = Corridor_room_1_3_area / Corridor_rooms_1_w

        #Side 1 - room 1
        Corridor_room_1_1 = createRoom(Footprint_w / 2 + offset, 0, Corridor_rooms_1_w, Corridor_room_1_1_h)
        Corridor_room_1_1_p1 = rg.Point3d(0,Footprint_w / 2 + offset,0)
        Corridor_room_1_1_p2 = rg.Point3d(Corridor_room_1_1_h,Footprint_w / 2 + offset,0)
        Corridor_room_1_1_p3 = rg.Point3d(Corridor_room_1_1_h,Footprint_w,0)
        Corridor_room_1_1_p4 = rg.Point3d(0,Footprint_w,0)
        Bathroom1_geometry = rg.Rectangle3d(plane, Corridor_room_1_1_p1, Corridor_room_1_1_p3)

        #Extracting Side 1 - room 1 info
        Corridor_room_1_1_area_round = round_num_up(Corridor_room_1_1_area, decimals = 2)
        Bathroom1_info = "Area: " + str(Corridor_room_1_1_area_round) + " m2"

        #Side 1 - room 2
        Corridor_room_1_2 = createRoom(Footprint_w / 2 + offset, Corridor_room_1_1_h, Corridor_rooms_1_w, Corridor_room_1_2_h)
        Corridor_room_1_2_p1 = rg.Point3d(Corridor_room_1_1_h,Footprint_w / 2 + offset,0)
        Corridor_room_1_2_p2 = rg.Point3d(Corridor_room_1_1_h + Corridor_room_1_2_h,Footprint_w / 2 + offset,0)
        Corridor_room_1_2_p3 = rg.Point3d(Corridor_room_1_1_h + Corridor_room_1_2_h,Footprint_w,0)
        Corridor_room_1_2_p4 = rg.Point3d(Corridor_room_1_1_h,Footprint_w,0)
        Bedroom1_geometry = rg.Rectangle3d(plane, Corridor_room_1_2_p1, Corridor_room_1_2_p3)

        #Extracting Side 1 - room 2 info
        Corridor_room_1_2_area_round = round_num_up(Corridor_room_1_2_area, decimals = 2)
        Bedroom1_info = "Area: " + str(Corridor_room_1_2_area_round) + " m2"

        #Side 1 - room 3
        Corridor_room_1_3 = createRoom(Footprint_w / 2 + offset, Corridor_room_1_2_h, Corridor_rooms_1_w, Corridor_room_1_3_h)
        Corridor_room_1_3_p1 = rg.Point3d(Corridor_room_1_1_h + Corridor_room_1_2_h,Footprint_w / 2 + offset,0)
        Corridor_room_1_3_p2 = rg.Point3d(Footprint_h * Corridor_h,Footprint_w / 2 + offset,0)
        Corridor_room_1_3_p3 = rg.Point3d(Footprint_h * Corridor_h,Footprint_w,0)
        Corridor_room_1_3_p4 = rg.Point3d(Corridor_room_1_1_h + Corridor_room_1_2_h,Footprint_w,0)
        Kitchen_geometry = rg.Rectangle3d(plane, Corridor_room_1_3_p1, Corridor_room_1_3_p3)

        #Extracting Side 1 - room 3 info
        Corridor_room_1_3_area_round = round_num_up(Corridor_room_1_3_area, decimals = 2)
        Kitchen_info = "Area: " + str(Corridor_room_1_3_area_round) + " m2"

        #Creating 2 rooms on side 2 of the corridor with min area 12
        Corridor_rooms_2_min_area = 12
        Corridor_rooms_2_w = 0 + (Footprint_w / 2 - offset)
        Corridor_rooms_2_h = Footprint_h * Corridor_h
        Corridor_rooms_2_area = Corridor_rooms_2_w * Corridor_rooms_2_h
        Corridor_room_2_1_area = random.uniform(Corridor_rooms_2_min_area, Corridor_rooms_2_area - Corridor_rooms_2_min_area)
        Corridor_room_2_2_area = Corridor_rooms_2_area - Corridor_room_2_1_area
        Corridor_room_2_1_h = Corridor_room_2_1_area / Corridor_rooms_2_w
        Corridor_room_2_2_h = Corridor_room_2_2_area / Corridor_rooms_2_w

        #Side 2 - room 1
        Corridor_room_2_1 = createRoom(Footprint_w / 2 - offset, 0, Corridor_rooms_2_w, Corridor_room_2_1_h)
        Corridor_room_2_1_p1 = rg.Point3d(0,0,0)
        Corridor_room_2_1_p2 = rg.Point3d(Corridor_room_2_1_h,0,0)
        Corridor_room_2_1_p3 = rg.Point3d(Corridor_room_2_1_h,Corridor_rooms_2_w,0)
        Corridor_room_2_1_p4 = rg.Point3d(0,Corridor_rooms_2_w,0)
        Bedroom2_geometry = rg.Rectangle3d(plane, Corridor_room_2_1_p1, Corridor_room_2_1_p3)

        #Extracting Side 2 - room 1 info
        Corridor_room_2_1_area_round = round_num_up(Corridor_room_2_1_area, decimals = 2)
        Bedroom2_info = "Area: " + str(Corridor_room_2_1_area_round) + " m2"

        #Side 2 - room 2
        Corridor_room_2_2_h = createRoom(Footprint_w / 2 - offset, Corridor_room_2_2_h, Corridor_rooms_2_w, Corridor_room_2_2_h)
        Corridor_room_2_2_p1 = rg.Point3d(Corridor_room_2_1_h,0,0)
        Corridor_room_2_2_p2 = rg.Point3d(Footprint_h * Corridor_h,0,0)
        Corridor_room_2_2_p3 = rg.Point3d(Footprint_h * Corridor_h,Footprint_w / 2 - offset,0)
        Corridor_room_2_2_p4 = rg.Point3d(Corridor_room_2_1_h,Footprint_w / 2 - offset,0)
        Bedroom3_geometry = rg.Rectangle3d(plane, Corridor_room_2_2_p1, Corridor_room_2_2_p3)

        #Extracting Side 2 - room 2 info
        Corridor_room_2_2_area_round = round_num_up(Corridor_room_2_2_area, decimals = 2)
        Bedroom3_info = "Area: " + str(Corridor_room_2_2_area_round) + " m2"



      ########################################
      #Checking if the number of bedrooms is 4
      elif bedrooms == 4:
        out8 = "So you want a house with 4 bedrooms? Well, okay then."
        print(out8)

        #Creating plane for rooms
        origin = rg.Point3d(0,0,0)
        x_axis = rg.Vector3d(1,0,0)
        y_axis = rg.Vector3d(0,1,0)
        plane = rg.Plane(origin, x_axis, y_axis)

        #Creating a footprint with random area between 110 and 140 and random proporortions of sides between 1:1.75 and 1:2.25
        Footprint_area = random.uniform(110, 140)
        Footprint_aspect = random.uniform(1.75, 2.25)
        Footprint_w = math.sqrt(Footprint_area / Footprint_aspect)
        Footprint_h = Footprint_w * Footprint_aspect
        Footprint_create = createRoom(0,0, Footprint_w, Footprint_h)
        Footprint_p1 = rg.Point3d(0,0,0)
        Footprint_p2 = rg.Point3d(0,Footprint_w,0)
        Footprint_p3 = rg.Point3d(Footprint_h,Footprint_w,0)
        Footprint_p4 = rg.Point3d(Footprint_h,0,0)
        Footprint_geometry = rg.Rectangle3d(plane, Footprint_p1, Footprint_p3)

        #Extracting Footprint info
        Footprint_area_round = round_num_up(Footprint_area, decimals = 2)
        Footprint_info = "Area: " + str(Footprint_area_round) + " m2"

        #Creating Corridor in the center of the footprint, tangent to all rooms with 1,2m width
        offset = 0.6
        Corridor_h = random.uniform((Footprint_h - 4.5) / Footprint_h, (Footprint_h - 3.5) / Footprint_h)
        Corridor_p1 = rg.Point3d(0,Footprint_w / 2 - offset,0)
        Corridor_p2 = rg.Point3d(Footprint_h * Corridor_h,Footprint_w / 2 - offset,0)
        Corridor_p3 = rg.Point3d(Footprint_h * Corridor_h,Footprint_w / 2 + offset,0)
        Corridor_p4 = rg.Point3d(0,Footprint_w / 2 + offset,0)
        Corridor_geometry = rg.Rectangle3d(plane, Corridor_p1, Corridor_p3)

        #Extracting Corridor info
        Corridor_area = 1.2 * Footprint_h * Corridor_h
        Corridor_area_round = round_num_up(Corridor_area, decimals = 2)
        Corridor_info = "Area: " + str(Corridor_area_round) + " m2"

        #Creating Living room as the biggest room at the end of the corridor
        Corridor_h_rest = 1 - Corridor_h
        Living_create = createRoom(0, Footprint_h * Corridor_h, Footprint_w, Footprint_h * Corridor_h_rest)
        Living_p1 = rg.Point3d(Footprint_h * Corridor_h,0,0)
        Living_p2 = rg.Point3d(Footprint_h,0,0)
        Living_p3 = rg.Point3d(Footprint_h,Footprint_w,0)
        Living_p4 = rg.Point3d(Footprint_h * Corridor_h,Footprint_w,0)
        Living_geometry = rg.Rectangle3d(plane, Living_p1, Living_p3)

        #Extracting Living room info
        Living_area = Footprint_w * Footprint_h * Corridor_h_rest
        Living_area_round = round_num_up(Living_area, decimals = 2)
        Living_info = "Area: " + str(Living_area_round) + " m2"

        #Creating 4 rooms on side 1 of the corridor with min area 8
        Corridor_rooms_1_min_area = 8
        Corridor_rooms_1_w = Footprint_w - (Footprint_w / 2 + offset)
        Corridor_rooms_1_h = Footprint_h * Corridor_h
        Corridor_rooms_1_area = Corridor_rooms_1_w * Corridor_rooms_1_h
        Corridor_room_1_1_area = random.uniform(Corridor_rooms_1_min_area, Corridor_rooms_1_area - (Corridor_rooms_1_min_area * 3))
        Corridor_room_1_2_area = random.uniform(Corridor_rooms_1_min_area, Corridor_rooms_1_area - Corridor_room_1_1_area - (Corridor_rooms_1_min_area * 2))
        Corridor_room_1_3_area = random.uniform(Corridor_rooms_1_min_area, Corridor_rooms_1_area - Corridor_room_1_1_area - Corridor_room_1_2_area - Corridor_rooms_1_min_area)
        Corridor_room_1_4_area = Corridor_rooms_1_area - Corridor_room_1_1_area - Corridor_room_1_2_area - Corridor_room_1_3_area
        Corridor_room_1_1_h = Corridor_room_1_1_area / Corridor_rooms_1_w
        Corridor_room_1_2_h = Corridor_room_1_2_area / Corridor_rooms_1_w
        Corridor_room_1_3_h = Corridor_room_1_3_area / Corridor_rooms_1_w
        Corridor_room_1_4_h = Corridor_room_1_4_area / Corridor_rooms_1_w

        #Side 1 - room 1
        Corridor_room_1_1 = createRoom(Footprint_w / 2 + offset, 0, Corridor_rooms_1_w, Corridor_room_1_1_h)
        Corridor_room_1_1_p1 = rg.Point3d(0,Footprint_w / 2 + offset,0)
        Corridor_room_1_1_p2 = rg.Point3d(Corridor_room_1_1_h,Footprint_w / 2 + offset,0)
        Corridor_room_1_1_p3 = rg.Point3d(Corridor_room_1_1_h,Footprint_w,0)
        Corridor_room_1_1_p4 = rg.Point3d(0,Footprint_w,0)
        Bathroom1_geometry = rg.Rectangle3d(plane, Corridor_room_1_1_p1, Corridor_room_1_1_p3)

        #Extracting Side 1 - room 1 info
        Corridor_room_1_1_area_round = round_num_up(Corridor_room_1_1_area, decimals = 2)
        Bathroom1_info = "Area: " + str(Corridor_room_1_1_area_round) + " m2"

        #Side 1 - room 2
        Corridor_room_1_2 = createRoom(Footprint_w / 2 + offset, Corridor_room_1_1_h, Corridor_rooms_1_w, Corridor_room_1_2_h)
        Corridor_room_1_2_p1 = rg.Point3d(Corridor_room_1_1_h,Footprint_w / 2 + offset,0)
        Corridor_room_1_2_p2 = rg.Point3d(Corridor_room_1_1_h + Corridor_room_1_2_h,Footprint_w / 2 + offset,0)
        Corridor_room_1_2_p3 = rg.Point3d(Corridor_room_1_1_h + Corridor_room_1_2_h,Footprint_w,0)
        Corridor_room_1_2_p4 = rg.Point3d(Corridor_room_1_1_h,Footprint_w,0)
        Bathroom2_geometry = rg.Rectangle3d(plane, Corridor_room_1_2_p1, Corridor_room_1_2_p3)

        #Extracting Side 1 - room 2 info
        Corridor_room_1_2_area_round = round_num_up(Corridor_room_1_2_area, decimals = 2)
        Bathroom2_info = "Area: " + str(Corridor_room_1_2_area_round) + " m2"

        #Side 1 - room 3
        Corridor_room_1_3 = createRoom(Footprint_w / 2 + offset, Corridor_room_1_2_h, Corridor_rooms_1_w, Corridor_room_1_3_h)
        Corridor_room_1_3_p1 = rg.Point3d(Corridor_room_1_1_h + Corridor_room_1_2_h,Footprint_w / 2 + offset,0)
        Corridor_room_1_3_p2 = rg.Point3d(Corridor_room_1_1_h + Corridor_room_1_2_h + Corridor_room_1_3_h,Footprint_w / 2 + offset,0)
        Corridor_room_1_3_p3 = rg.Point3d(Corridor_room_1_1_h + Corridor_room_1_2_h + Corridor_room_1_3_h,Footprint_w,0)
        Corridor_room_1_3_p4 = rg.Point3d(Corridor_room_1_1_h + Corridor_room_1_2_h,Footprint_w,0)
        Bedroom1_geometry = rg.Rectangle3d(plane, Corridor_room_1_3_p1, Corridor_room_1_3_p3)

        #Extracting Side 1 - room 3 info
        Corridor_room_1_3_area_round = round_num_up(Corridor_room_1_3_area, decimals = 2)
        Bedroom1_info = "Area: " + str(Corridor_room_1_3_area_round) + " m2"

        #Side 1 - room 4
        Corridor_room_1_4 = createRoom(Footprint_w / 2 + offset, Corridor_room_1_3_h, Corridor_rooms_1_w, Corridor_room_1_4_h)
        Corridor_room_1_4_p1 = rg.Point3d(Corridor_room_1_1_h + Corridor_room_1_2_h + Corridor_room_1_3_h,Footprint_w / 2 + offset,0)
        Corridor_room_1_4_p2 = rg.Point3d(Footprint_h * Corridor_h,Footprint_w / 2 + offset,0)
        Corridor_room_1_4_p3 = rg.Point3d(Footprint_h * Corridor_h,Footprint_w,0)
        Corridor_room_1_4_p4 = rg.Point3d(Corridor_room_1_1_h + Corridor_room_1_2_h + Corridor_room_1_3_h,Footprint_w,0)
        Kitchen_geometry = rg.Rectangle3d(plane, Corridor_room_1_4_p1, Corridor_room_1_4_p3)

        #Extracting Side 1 - room 4 info
        Corridor_room_1_4_area_round = round_num_up(Corridor_room_1_4_area, decimals = 2)
        Kitchen_info = "Area: " + str(Corridor_room_1_4_area_round) + " m2"

        #Creating 3 rooms on side 2 of the corridor with min area 12
        Corridor_rooms_2_min_area = 12
        Corridor_rooms_2_w = Footprint_w - (Footprint_w / 2 - offset)
        Corridor_rooms_2_h = Footprint_h * Corridor_h
        Corridor_rooms_2_area = Corridor_rooms_2_w * Corridor_rooms_2_h
        Corridor_room_2_1_area = random.uniform(Corridor_rooms_2_min_area, Corridor_rooms_2_area - (Corridor_rooms_2_min_area * 2))
        Corridor_room_2_2_area = random.uniform(Corridor_rooms_2_min_area, Corridor_rooms_2_area - Corridor_room_2_1_area - Corridor_rooms_2_min_area)
        Corridor_room_2_3_area = Corridor_rooms_2_area - Corridor_room_2_1_area - Corridor_room_2_2_area
        Corridor_room_2_1_h = Corridor_room_2_1_area / Corridor_rooms_2_w
        Corridor_room_2_2_h = Corridor_room_2_2_area / Corridor_rooms_2_w
        Corridor_room_2_3_h = Corridor_room_2_3_area / Corridor_rooms_2_w

        #Side 2 - room 1
        Corridor_room_2_1 = createRoom(Footprint_w / 2 - offset, 0, Corridor_rooms_2_w, Corridor_room_2_1_h)
        Corridor_room_2_1_p1 = rg.Point3d(0,0,0)
        Corridor_room_2_1_p2 = rg.Point3d(Corridor_room_2_1_h,0,0)
        Corridor_room_2_1_p3 = rg.Point3d(Corridor_room_2_1_h,Footprint_w / 2 - offset,0)
        Corridor_room_2_1_p4 = rg.Point3d(0,Footprint_w / 2 - offset,0)
        Bedroom2_geometry = rg.Rectangle3d(plane, Corridor_room_2_1_p1, Corridor_room_2_1_p3)

        #Extracting Side 2 - room 1 info
        Corridor_room_2_1_area_round = round_num_up(Corridor_room_2_1_area, decimals = 2)
        Bedroom2_info = "Area: " + str(Corridor_room_2_1_area_round) + " m2"

        #Side 2 - room 2
        Corridor_room_2_2 = createRoom(Footprint_w / 2 - offset, Corridor_room_2_1_h, Corridor_rooms_2_w, Corridor_room_2_2_h)
        Corridor_room_2_2_p1 = rg.Point3d(Corridor_room_2_1_h,0,0)
        Corridor_room_2_2_p2 = rg.Point3d(Corridor_room_2_1_h + Corridor_room_2_2_h,0,0)
        Corridor_room_2_2_p3 = rg.Point3d(Corridor_room_2_1_h + Corridor_room_2_2_h,Footprint_w / 2 - offset,0)
        Corridor_room_2_2_p4 = rg.Point3d(Corridor_room_2_1_h,Footprint_w / 2 - offset,0)
        Bedroom3_geometry = rg.Rectangle3d(plane, Corridor_room_2_2_p1, Corridor_room_2_2_p3)

        #Extracting Side 2 - room 2 info
        Corridor_room_2_2_area_round = round_num_up(Corridor_room_2_2_area, decimals = 2)
        Bedroom3_info = "Area: " + str(Corridor_room_2_2_area_round) + " m2"

        #Side 2 - room 3
        Corridor_room_2_3 = createRoom(Footprint_w / 2 - offset, Corridor_room_2_2_h, Corridor_rooms_2_w, Corridor_room_2_3_h)
        Corridor_room_2_3_p1 = rg.Point3d(Corridor_room_2_1_h + Corridor_room_2_2_h,0,0)
        Corridor_room_2_3_p2 = rg.Point3d(Footprint_h * Corridor_h,0,0)
        Corridor_room_2_3_p3 = rg.Point3d(Footprint_h * Corridor_h,Footprint_w / 2 - offset,0)
        Corridor_room_2_3_p4 = rg.Point3d(Corridor_room_2_1_h + Corridor_room_2_2_h,Footprint_w / 2 - offset,0)
        Bedroom4_geometry = rg.Rectangle3d(plane, Corridor_room_2_3_p1, Corridor_room_2_3_p3)

        #Extracting Side 2 - room 3 info
        Corridor_room_2_3_area_round = round_num_up(Corridor_room_2_3_area, decimals = 2)
        Bedroom4_info = "Area: " + str(Corridor_room_2_3_area_round) + " m2"



      ########################################
      #Checking if the number of bedrooms is 5
      elif bedrooms == 5:
        out9 = "So you want a house with 5 bedrooms? Well, okay then."
        print(out9)

        #Creating plane for rooms
        origin = rg.Point3d(0,0,0)
        x_axis = rg.Vector3d(1,0,0)
        y_axis = rg.Vector3d(0,1,0)
        plane = rg.Plane(origin, x_axis, y_axis)

        #Creating a footprint with random area between 130 and 180 and random proporortions of sides between 1:1.8 and 1:2.3
        Footprint_area = random.uniform(130, 180)
        Footprint_aspect = random.uniform(1.8, 2.3)
        Footprint_w = math.sqrt(Footprint_area / Footprint_aspect)
        Footprint_h = Footprint_w * Footprint_aspect
        Footprint_create = createRoom(0,0, Footprint_w, Footprint_h)
        Footprint_p1 = rg.Point3d(0,0,0)
        Footprint_p2 = rg.Point3d(0,Footprint_w,0)
        Footprint_p3 = rg.Point3d(Footprint_h,Footprint_w,0)
        Footprint_p4 = rg.Point3d(Footprint_h,0,0)
        Footprint_geometry = rg.Rectangle3d(plane, Footprint_p1, Footprint_p3)

        #Extracting Footprint info
        Footprint_area_round = round_num_up(Footprint_area, decimals = 2)
        Footprint_info = "Area: " + str(Footprint_area_round) + " m2"

        #Creating Corridor in the center of the footprint, tangent to all rooms with 1,2m width
        offset = 0.6
        Corridor_h = random.uniform((Footprint_h - 4.5) / Footprint_h, (Footprint_h - 3.5) / Footprint_h)
        Corridor_p1 = rg.Point3d(0,Footprint_w / 2 - offset,0)
        Corridor_p2 = rg.Point3d(Footprint_h * Corridor_h,Footprint_w / 2 - offset,0)
        Corridor_p3 = rg.Point3d(Footprint_h * Corridor_h,Footprint_w / 2 + offset,0)
        Corridor_p4 = rg.Point3d(0,Footprint_w / 2 + offset,0)
        Corridor_geometry = rg.Rectangle3d(plane, Corridor_p1, Corridor_p3)

        #Extracting Corridor info
        Corridor_area = 1.2 * Footprint_h * Corridor_h
        Corridor_area_round = round_num_up(Corridor_area, decimals = 2)
        Corridor_info = "Area: " + str(Corridor_area_round) + " m2"

        #Creating Living room as the biggest room at the end of the corridor
        Corridor_h_rest = 1 - Corridor_h
        Living_create = createRoom(0, Footprint_h * Corridor_h, Footprint_w, Footprint_h * Corridor_h_rest)
        Living_p1 = rg.Point3d(Footprint_h * Corridor_h,0,0)
        Living_p2 = rg.Point3d(Footprint_h,0,0)
        Living_p3 = rg.Point3d(Footprint_h,Footprint_w,0)
        Living_p4 = rg.Point3d(Footprint_h * Corridor_h,Footprint_w,0)
        Living_geometry = rg.Rectangle3d(plane, Living_p1, Living_p3)

        #Extracting Living room info
        Living_area = Footprint_w * Footprint_h * Corridor_h_rest
        Living_area_round = round_num_up(Living_area, decimals = 2)
        Living_info = "Area: " + str(Living_area_round) + " m2"

        #Creating 4 rooms on side 1 of the corridor with min area 10
        Corridor_rooms_1_min_area = 10
        Corridor_rooms_1_w = Footprint_w - (Footprint_w / 2 + offset)
        Corridor_rooms_1_h = Footprint_h * Corridor_h
        Corridor_rooms_1_area = Corridor_rooms_1_w * Corridor_rooms_1_h
        Corridor_room_1_1_area = random.uniform(Corridor_rooms_1_min_area, Corridor_rooms_1_area - (Corridor_rooms_1_min_area * 3))
        Corridor_room_1_2_area = random.uniform(Corridor_rooms_1_min_area, Corridor_rooms_1_area - Corridor_room_1_1_area - (Corridor_rooms_1_min_area * 2))
        Corridor_room_1_3_area = random.uniform(Corridor_rooms_1_min_area, Corridor_rooms_1_area - Corridor_room_1_1_area - Corridor_room_1_2_area - Corridor_rooms_1_min_area)
        Corridor_room_1_4_area = Corridor_rooms_1_area - Corridor_room_1_1_area - Corridor_room_1_2_area - Corridor_room_1_3_area
        Corridor_room_1_1_h = Corridor_room_1_1_area / Corridor_rooms_1_w
        Corridor_room_1_2_h = Corridor_room_1_2_area / Corridor_rooms_1_w
        Corridor_room_1_3_h = Corridor_room_1_3_area / Corridor_rooms_1_w
        Corridor_room_1_4_h = Corridor_room_1_4_area / Corridor_rooms_1_w

        #Side 1 - room 1
        Corridor_room_1_1 = createRoom(Footprint_w / 2 + offset, 0, Corridor_rooms_1_w, Corridor_room_1_1_h)
        Corridor_room_1_1_p1 = rg.Point3d(0,Footprint_w / 2 + offset,0)
        Corridor_room_1_1_p2 = rg.Point3d(Corridor_room_1_1_h,Footprint_w / 2 + offset,0)
        Corridor_room_1_1_p3 = rg.Point3d(Corridor_room_1_1_h,Footprint_w,0)
        Corridor_room_1_1_p4 = rg.Point3d(0,Footprint_w,0)
        Bathroom1_geometry = rg.Rectangle3d(plane, Corridor_room_1_1_p1, Corridor_room_1_1_p3)

        #Extracting Side 1 - room 1 info
        Corridor_room_1_1_area_round = round_num_up(Corridor_room_1_1_area, decimals = 2)
        Bathroom1_info = "Area: " + str(Corridor_room_1_1_area_round) + " m2"

        #Side 1 - room 2
        Corridor_room_1_2 = createRoom(Footprint_w / 2 + offset, Corridor_room_1_1_h, Corridor_rooms_1_w, Corridor_room_1_2_h)
        Corridor_room_1_2_p1 = rg.Point3d(Corridor_room_1_1_h,Footprint_w / 2 + offset,0)
        Corridor_room_1_2_p2 = rg.Point3d(Corridor_room_1_1_h + Corridor_room_1_2_h,Footprint_w / 2 + offset,0)
        Corridor_room_1_2_p3 = rg.Point3d(Corridor_room_1_1_h + Corridor_room_1_2_h,Footprint_w,0)
        Corridor_room_1_2_p4 = rg.Point3d(Corridor_room_1_1_h,Footprint_w,0)
        Bathroom2_geometry = rg.Rectangle3d(plane, Corridor_room_1_2_p1, Corridor_room_1_2_p3)

        #Extracting Side 1 - room 2 info
        Corridor_room_1_2_area_round = round_num_up(Corridor_room_1_2_area, decimals = 2)
        Bathroom2_info = "Area: " + str(Corridor_room_1_2_area_round) + " m2"

        #Side 1 - room 3
        Corridor_room_1_3 = createRoom(Footprint_w / 2 + offset, Corridor_room_1_2_h, Corridor_rooms_1_w, Corridor_room_1_3_h)
        Corridor_room_1_3_p1 = rg.Point3d(Corridor_room_1_1_h + Corridor_room_1_2_h,Footprint_w / 2 + offset,0)
        Corridor_room_1_3_p2 = rg.Point3d(Corridor_room_1_1_h + Corridor_room_1_2_h + Corridor_room_1_3_h,Footprint_w / 2 + offset,0)
        Corridor_room_1_3_p3 = rg.Point3d(Corridor_room_1_1_h + Corridor_room_1_2_h + Corridor_room_1_3_h,Footprint_w,0)
        Corridor_room_1_3_p4 = rg.Point3d(Corridor_room_1_1_h + Corridor_room_1_2_h,Footprint_w,0)
        Bedroom1_geometry = rg.Rectangle3d(plane, Corridor_room_1_3_p1, Corridor_room_1_3_p3)

        #Extracting Side 1 - room 3 info
        Corridor_room_1_3_area_round = round_num_up(Corridor_room_1_3_area, decimals = 2)
        Bedroom1_info = "Area: " + str(Corridor_room_1_3_area_round) + " m2"

        #Side 1 - room 4
        Corridor_room_1_4 = createRoom(Footprint_w / 2 + offset, Corridor_room_1_3_h, Corridor_rooms_1_w, Corridor_room_1_4_h)
        Corridor_room_1_4_p1 = rg.Point3d(Corridor_room_1_1_h + Corridor_room_1_2_h + Corridor_room_1_3_h,Footprint_w / 2 + offset,0)
        Corridor_room_1_4_p2 = rg.Point3d(Footprint_h * Corridor_h,Footprint_w / 2 + offset,0)
        Corridor_room_1_4_p3 = rg.Point3d(Footprint_h * Corridor_h,Footprint_w,0)
        Corridor_room_1_4_p4 = rg.Point3d(Corridor_room_1_1_h + Corridor_room_1_2_h + Corridor_room_1_3_h,Footprint_w,0)
        Kitchen_geometry = rg.Rectangle3d(plane, Corridor_room_1_4_p1, Corridor_room_1_4_p3)

        #Extracting Side 1 - room 4 info
        Corridor_room_1_4_area_round = round_num_up(Corridor_room_1_4_area, decimals = 2)
        Kitchen_info = "Area: " + str(Corridor_room_1_4_area_round) + " m2"

        #Creating 4 rooms on side 2 of the corridor with min area 12
        Corridor_rooms_2_min_area = 12
        Corridor_rooms_2_w = Footprint_w - (Footprint_w / 2 - offset)
        Corridor_rooms_2_h = Footprint_h * Corridor_h
        Corridor_rooms_2_area = Corridor_rooms_2_w * Corridor_rooms_2_h
        Corridor_room_2_1_area = random.uniform(Corridor_rooms_2_min_area, Corridor_rooms_2_area - (Corridor_rooms_2_min_area * 3))
        Corridor_room_2_2_area = random.uniform(Corridor_rooms_2_min_area, Corridor_rooms_2_area - Corridor_room_2_1_area - (Corridor_rooms_2_min_area * 2))
        Corridor_room_2_3_area = random.uniform(Corridor_rooms_2_min_area, Corridor_rooms_2_area - Corridor_room_2_1_area - Corridor_room_2_2_area - Corridor_rooms_2_min_area )
        Corridor_room_2_4_area = Corridor_rooms_2_area - Corridor_room_2_1_area - Corridor_room_2_2_area - Corridor_room_2_3_area
        Corridor_room_2_1_h = Corridor_room_2_1_area / Corridor_rooms_2_w
        Corridor_room_2_2_h = Corridor_room_2_2_area / Corridor_rooms_2_w
        Corridor_room_2_3_h = Corridor_room_2_3_area / Corridor_rooms_2_w
        Corridor_room_2_4_h = Corridor_room_2_4_area / Corridor_rooms_2_w

        #Side 2 - room 1
        Corridor_room_2_1 = createRoom(Footprint_w / 2 - offset, 0, Corridor_rooms_2_w, Corridor_room_2_1_h)
        Corridor_room_2_1_p1 = rg.Point3d(0,0,0)
        Corridor_room_2_1_p2 = rg.Point3d(Corridor_room_2_1_h,0,0)
        Corridor_room_2_1_p3 = rg.Point3d(Corridor_room_2_1_h,Footprint_w / 2 - offset,0)
        Corridor_room_2_1_p4 = rg.Point3d(0,Footprint_w / 2 - offset,0)
        Bedroom2_geometry = rg.Rectangle3d(plane, Corridor_room_2_1_p1, Corridor_room_2_1_p3)

        #Extracting Side 2 - room 1 info
        Corridor_room_2_1_area_round = round_num_up(Corridor_room_2_1_area, decimals = 2)
        Bedroom2_info = "Area: " + str(Corridor_room_2_1_area_round) + " m2"

        #Side 2 - room 2
        Corridor_room_2_2 = createRoom(Footprint_w / 2 - offset, Corridor_room_2_1_h, Corridor_rooms_2_w, Corridor_room_2_2_h)
        Corridor_room_2_2_p1 = rg.Point3d(Corridor_room_2_1_h,0,0)
        Corridor_room_2_2_p2 = rg.Point3d(Corridor_room_2_1_h + Corridor_room_2_2_h,0,0)
        Corridor_room_2_2_p3 = rg.Point3d(Corridor_room_2_1_h + Corridor_room_2_2_h,Footprint_w / 2 - offset,0)
        Corridor_room_2_2_p4 = rg.Point3d(Corridor_room_2_1_h,Footprint_w / 2 - offset,0)
        Bedroom3_geometry = rg.Rectangle3d(plane, Corridor_room_2_2_p1, Corridor_room_2_2_p3)

        #Extracting Side 2 - room 2 info
        Corridor_room_2_2_area_round = round_num_up(Corridor_room_2_2_area, decimals = 2)
        Bedroom3_info = "Area: " + str(Corridor_room_2_2_area_round) + " m2"

        #Side 2 - room 3
        Corridor_room_2_3 = createRoom(Footprint_w / 2 - offset, Corridor_room_2_2_h, Corridor_rooms_2_w, Corridor_room_2_3_h)
        Corridor_room_2_3_p1 = rg.Point3d(Corridor_room_2_1_h + Corridor_room_2_2_h,0,0)
        Corridor_room_2_3_p2 = rg.Point3d(Corridor_room_2_1_h + Corridor_room_2_2_h + Corridor_room_2_3_h,0,0)
        Corridor_room_2_3_p3 = rg.Point3d(Corridor_room_2_1_h + Corridor_room_2_2_h + Corridor_room_2_3_h,Footprint_w / 2 - offset,0)
        Corridor_room_2_3_p4 = rg.Point3d(Corridor_room_2_1_h + Corridor_room_2_2_h,Footprint_w / 2 - offset,0)
        Bedroom4_geometry = rg.Rectangle3d(plane, Corridor_room_2_3_p1, Corridor_room_2_3_p3)

        #Extracting Side 2 - room 3 info
        Corridor_room_2_3_area_round = round_num_up(Corridor_room_2_3_area, decimals = 2)
        Bedroom4_info = "Area: " + str(Corridor_room_2_3_area_round) + " m2"

        #Side 2 - room 4
        Corridor_room_2_4 = createRoom(Footprint_w / 2 - offset, Corridor_room_2_3_h, Corridor_rooms_2_w, Corridor_room_2_4_h)
        Corridor_room_2_4_p1 = rg.Point3d(Corridor_room_2_1_h + Corridor_room_2_2_h + Corridor_room_2_3_h,0,0)
        Corridor_room_2_4_p2 = rg.Point3d(Footprint_h * Corridor_h,0,0)
        Corridor_room_2_4_p3 = rg.Point3d(Footprint_h * Corridor_h,Footprint_w / 2 - offset,0)
        Corridor_room_2_4_p4 = rg.Point3d(Corridor_room_2_1_h + Corridor_room_2_2_h + Corridor_room_2_3_h,Footprint_w / 2 - offset,0)
        Bedroom5_geometry = rg.Rectangle3d(plane, Corridor_room_2_4_p1, Corridor_room_2_4_p3)

        #Extracting Side 2 - room 4 info
        Corridor_room_2_4_area_round = round_num_up(Corridor_room_2_4_area, decimals = 2)
        Bedroom5_info = "Area: " + str(Corridor_room_2_4_area_round) + " m2"



    else:
      #If here is a word "bedrooms" but there is no number, generate a random number between 2 and 5
      number = random.uniform(2, 5)
      number_round = round_num_up(number, decimals = 0)
      out3 = "No number / Wrong number of bedrooms detected. Random generated number is " + str(number_round) + "."
      print(out3)



      ########################################
      #Checking if the number of bedrooms is 2
      if number_round == 2.0:
        out6 = "So you want a house with 2 bedrooms? Well, okay then."
        print(out6)

        #Creating plane for rooms
        origin = rg.Point3d(0,0,0)
        x_axis = rg.Vector3d(1,0,0)
        y_axis = rg.Vector3d(0,1,0)
        plane = rg.Plane(origin, x_axis, y_axis)

        #Creating a footprint with random area between 60 and 80 and random proporortions of sides between 1:1.2 and 1:2
        Footprint_area = random.uniform(60, 80)
        Footprint_aspect = random.uniform(1.2, 2)
        Footprint_w = math.sqrt(Footprint_area / Footprint_aspect)
        Footprint_h = Footprint_w * Footprint_aspect
        Footprint_create = createRoom(0,0, Footprint_w, Footprint_h)
        Footprint_p1 = rg.Point3d(0,0,0)
        Footprint_p2 = rg.Point3d(0,Footprint_w,0)
        Footprint_p3 = rg.Point3d(Footprint_h,Footprint_w,0)
        Footprint_p4 = rg.Point3d(Footprint_h,0,0)
        Footprint_geometry = rg.Rectangle3d(plane, Footprint_p1, Footprint_p3)

        #Extracting Footprint info
        Footprint_area_round = round_num_up(Footprint_area, decimals = 2)
        Footprint_info = "Area: " + str(Footprint_area_round) + " m2"

        #Creating Corridor in the center of the footprint, tangent to all rooms with 1,2m width
        offset = 0.6
        Corridor_h = random.uniform((Footprint_h - 4) / Footprint_h, (Footprint_h - 3) / Footprint_h)
        Corridor_p1 = rg.Point3d(0,Footprint_w / 2 - offset,0)
        Corridor_p2 = rg.Point3d(Footprint_h * Corridor_h,Footprint_w / 2 - offset,0)
        Corridor_p3 = rg.Point3d(Footprint_h * Corridor_h,Footprint_w / 2 + offset,0)
        Corridor_p4 = rg.Point3d(0,Footprint_w / 2 + offset,0)
        Corridor_geometry = rg.Rectangle3d(plane, Corridor_p1, Corridor_p3)

        #Extracting Corridor info
        Corridor_area = 1.2 * Footprint_h * Corridor_h
        Corridor_area_round = round_num_up(Corridor_area, decimals = 2)
        Corridor_info = "Area: " + str(Corridor_area_round) + " m2"

        #Creating Living room as the biggest room at the end of the corridor
        Corridor_h_rest = 1 - Corridor_h
        Living_create = createRoom(0, Footprint_h * Corridor_h, Footprint_w, Footprint_h * Corridor_h_rest)
        Living_p1 = rg.Point3d(Footprint_h * Corridor_h,0,0)
        Living_p2 = rg.Point3d(Footprint_h,0,0)
        Living_p3 = rg.Point3d(Footprint_h,Footprint_w,0)
        Living_p4 = rg.Point3d(Footprint_h * Corridor_h,Footprint_w,0)
        Living_geometry = rg.Rectangle3d(plane, Living_p1, Living_p3)

        #Extracting Living room info
        Living_area = Footprint_w * Footprint_h * Corridor_h_rest
        Living_area_round = round_num_up(Living_area, decimals = 2)
        Living_info = "Area: " + str(Living_area_round) + " m2"

        #Creating 2 rooms on side 1 of the corridor with min area 6
        Corridor_rooms_1_min_area = 6
        Corridor_rooms_1_w = Footprint_w - (Footprint_w / 2 + offset)
        Corridor_rooms_1_h = Footprint_h * Corridor_h
        Corridor_rooms_1_area = Corridor_rooms_1_w * Corridor_rooms_1_h
        Corridor_room_1_1_area = random.uniform(Corridor_rooms_1_min_area, Corridor_rooms_1_area - Corridor_rooms_1_min_area)
        Corridor_room_1_2_area = Corridor_rooms_1_area - Corridor_room_1_1_area
        Corridor_room_1_1_h = Corridor_room_1_1_area / Corridor_rooms_1_w
        Corridor_room_1_2_h = Corridor_room_1_2_area / Corridor_rooms_1_w

        #Side 1 - room 1
        Corridor_room_1_1 = createRoom(Footprint_w / 2 + offset, 0, Corridor_rooms_1_w, Corridor_room_1_1_h)
        Corridor_room_1_1_p1 = rg.Point3d(0,Footprint_w / 2 + offset,0)
        Corridor_room_1_1_p2 = rg.Point3d(Corridor_room_1_1_h,Footprint_w / 2 + offset,0)
        Corridor_room_1_1_p3 = rg.Point3d(Corridor_room_1_1_h,Footprint_w,0)
        Corridor_room_1_1_p4 = rg.Point3d(0,Footprint_w,0)
        Bathroom1_geometry = rg.Rectangle3d(plane, Corridor_room_1_1_p1, Corridor_room_1_1_p3)

        #Extracting Side 1 - room 1 info
        Corridor_room_1_1_area_round = round_num_up(Corridor_room_1_1_area, decimals = 2)
        Bathroom1_info = "Area: " + str(Corridor_room_1_1_area_round) + " m2"

        #Side 1 - room 2
        Corridor_room_1_2_h = createRoom(Footprint_w / 2 + offset, Corridor_room_1_1_h, Corridor_rooms_1_w, Corridor_room_1_2_h)
        Corridor_room_1_2_p1 = rg.Point3d(Corridor_room_1_1_h,Footprint_w / 2 + offset,0)
        Corridor_room_1_2_p2 = rg.Point3d(Footprint_h * Corridor_h,Footprint_w / 2 + offset,0)
        Corridor_room_1_2_p3 = rg.Point3d(Footprint_h * Corridor_h,Footprint_w,0)
        Corridor_room_1_2_p4 = rg.Point3d(Corridor_room_1_1_h,Footprint_w,0)
        Kitchen_geometry = rg.Rectangle3d(plane, Corridor_room_1_2_p1, Corridor_room_1_2_p3)

        #Extracting Side 1 - room 2 info
        Corridor_room_1_2_area_round = round_num_up(Corridor_room_1_2_area, decimals = 2)
        Kitchen_info = "Area: " + str(Corridor_room_1_2_area_round) + " m2"

        #Creating 2 rooms on side 2 of the corridor with min area 8
        Corridor_rooms_2_min_area = 8
        Corridor_rooms_2_w = 0 + (Footprint_w / 2 - offset)
        Corridor_rooms_2_h = Footprint_h * Corridor_h
        Corridor_rooms_2_area = Corridor_rooms_2_w * Corridor_rooms_2_h
        Corridor_room_2_1_area = random.uniform(Corridor_rooms_2_min_area, Corridor_rooms_2_area - Corridor_rooms_2_min_area)
        Corridor_room_2_2_area = Corridor_rooms_2_area - Corridor_room_2_1_area
        Corridor_room_2_1_h = Corridor_room_2_1_area / Corridor_rooms_2_w
        Corridor_room_2_2_h = Corridor_room_2_2_area / Corridor_rooms_2_w

        #Side 2 - room 1
        Corridor_room_2_1 = createRoom(Footprint_w / 2 - offset, 0, Corridor_rooms_2_w, Corridor_room_2_1_h)
        Corridor_room_2_1_p1 = rg.Point3d(0,0,0)
        Corridor_room_2_1_p2 = rg.Point3d(Corridor_room_2_1_h,0,0)
        Corridor_room_2_1_p3 = rg.Point3d(Corridor_room_2_1_h,Corridor_rooms_2_w,0)
        Corridor_room_2_1_p4 = rg.Point3d(0,Corridor_rooms_2_w,0)
        Bedroom1_geometry = rg.Rectangle3d(plane, Corridor_room_2_1_p1, Corridor_room_2_1_p3)

        #Extracting Side 2 - room 1 info
        Corridor_room_2_1_area_round = round_num_up(Corridor_room_2_1_area, decimals = 2)
        Bedroom1_info = "Area: " + str(Corridor_room_2_1_area_round) + " m2"

        #Side 2 - room 2
        Corridor_room_2_2_h = createRoom(Footprint_w / 2 - offset, Corridor_room_2_2_h, Corridor_rooms_2_w, Corridor_room_2_2_h)
        Corridor_room_2_2_p1 = rg.Point3d(Corridor_room_2_1_h,0,0)
        Corridor_room_2_2_p2 = rg.Point3d(Footprint_h * Corridor_h,0,0)
        Corridor_room_2_2_p3 = rg.Point3d(Footprint_h * Corridor_h,Footprint_w / 2 - offset,0)
        Corridor_room_2_2_p4 = rg.Point3d(Corridor_room_2_1_h,Footprint_w / 2 - offset,0)
        Bedroom2_geometry = rg.Rectangle3d(plane, Corridor_room_2_2_p1, Corridor_room_2_2_p3)

        #Extracting Side 2 - room 2 info
        Corridor_room_2_2_area_round = round_num_up(Corridor_room_2_2_area, decimals = 2)
        Bedroom2_info = "Area: " + str(Corridor_room_2_2_area_round) + " m2"



      ########################################
      #Checking if the number of bedrooms is 3
      elif number_round == 3.0:
        out7 = "So you want a house with 3 bedrooms? Well, okay then."
        print(out7)

        #Creating plane for rooms
        origin = rg.Point3d(0,0,0)
        x_axis = rg.Vector3d(1,0,0)
        y_axis = rg.Vector3d(0,1,0)
        plane = rg.Plane(origin, x_axis, y_axis)

        #Creating a footprint with random area between 85 and 100 and random proporortions of sides between 1:1.5 and 1:2.25
        Footprint_area = random.uniform(85, 100)
        Footprint_aspect = random.uniform(1.5, 2.25)
        Footprint_w = math.sqrt(Footprint_area / Footprint_aspect)
        Footprint_h = Footprint_w * Footprint_aspect
        Footprint_create = createRoom(0,0, Footprint_w, Footprint_h)
        Footprint_p1 = rg.Point3d(0,0,0)
        Footprint_p2 = rg.Point3d(0,Footprint_w,0)
        Footprint_p3 = rg.Point3d(Footprint_h,Footprint_w,0)
        Footprint_p4 = rg.Point3d(Footprint_h,0,0)
        Footprint_geometry = rg.Rectangle3d(plane, Footprint_p1, Footprint_p3)

        #Extracting Footprint info
        Footprint_area_round = round_num_up(Footprint_area, decimals = 2)
        Footprint_info = "Area: " + str(Footprint_area_round) + " m2"

        #Creating Corridor in the center of the footprint, tangent to all rooms with 1,2m width
        offset = 0.6
        Corridor_h = random.uniform((Footprint_h - 4) / Footprint_h, (Footprint_h - 3) / Footprint_h)
        Corridor_p1 = rg.Point3d(0,Footprint_w / 2 - offset,0)
        Corridor_p2 = rg.Point3d(Footprint_h * Corridor_h,Footprint_w / 2 - offset,0)
        Corridor_p3 = rg.Point3d(Footprint_h * Corridor_h,Footprint_w / 2 + offset,0)
        Corridor_p4 = rg.Point3d(0,Footprint_w / 2 + offset,0)
        Corridor_geometry = rg.Rectangle3d(plane, Corridor_p1, Corridor_p3)

        #Extracting Corridor info
        Corridor_area = 1.2 * Footprint_h * Corridor_h
        Corridor_area_round = round_num_up(Corridor_area, decimals = 2)
        Corridor_info = "Area: " + str(Corridor_area_round) + " m2"

        #Creating Living room as the biggest room at the end of the corridor
        Corridor_h_rest = 1 - Corridor_h
        Living_create = createRoom(0, Footprint_h * Corridor_h, Footprint_w, Footprint_h * Corridor_h_rest)
        Living_p1 = rg.Point3d(Footprint_h * Corridor_h,0,0)
        Living_p2 = rg.Point3d(Footprint_h,0,0)
        Living_p3 = rg.Point3d(Footprint_h,Footprint_w,0)
        Living_p4 = rg.Point3d(Footprint_h * Corridor_h,Footprint_w,0)
        Living_geometry = rg.Rectangle3d(plane, Living_p1, Living_p3)

        #Extracting Living room info
        Living_area = Footprint_w * Footprint_h * Corridor_h_rest
        Living_area_round = round_num_up(Living_area, decimals = 2)
        Living_info = "Area: " + str(Living_area_round) + " m2"

        #Creating 3 rooms on side 1 of the corridor with min area 8
        Corridor_rooms_1_min_area = 8
        Corridor_rooms_1_w = Footprint_w - (Footprint_w / 2 + offset)
        Corridor_rooms_1_h = Footprint_h * Corridor_h
        Corridor_rooms_1_area = Corridor_rooms_1_w * Corridor_rooms_1_h
        Corridor_room_1_1_area = random.uniform(Corridor_rooms_1_min_area, Corridor_rooms_1_area - (Corridor_rooms_1_min_area * 2))
        Corridor_room_1_2_area = random.uniform(Corridor_rooms_1_min_area, Corridor_rooms_1_area - Corridor_room_1_1_area - Corridor_rooms_1_min_area)
        Corridor_room_1_3_area = Corridor_rooms_1_area - Corridor_room_1_1_area - Corridor_room_1_2_area
        Corridor_room_1_1_h = Corridor_room_1_1_area / Corridor_rooms_1_w
        Corridor_room_1_2_h = Corridor_room_1_2_area / Corridor_rooms_1_w
        Corridor_room_1_3_h = Corridor_room_1_3_area / Corridor_rooms_1_w

        #Side 1 - room 1
        Corridor_room_1_1 = createRoom(Footprint_w / 2 + offset, 0, Corridor_rooms_1_w, Corridor_room_1_1_h)
        Corridor_room_1_1_p1 = rg.Point3d(0,Footprint_w / 2 + offset,0)
        Corridor_room_1_1_p2 = rg.Point3d(Corridor_room_1_1_h,Footprint_w / 2 + offset,0)
        Corridor_room_1_1_p3 = rg.Point3d(Corridor_room_1_1_h,Footprint_w,0)
        Corridor_room_1_1_p4 = rg.Point3d(0,Footprint_w,0)
        Bathroom1_geometry = rg.Rectangle3d(plane, Corridor_room_1_1_p1, Corridor_room_1_1_p3)

        #Extracting Side 1 - room 1 info
        Corridor_room_1_1_area_round = round_num_up(Corridor_room_1_1_area, decimals = 2)
        Bathroom1_info = "Area: " + str(Corridor_room_1_1_area_round) + " m2"

        #Side 1 - room 2
        Corridor_room_1_2 = createRoom(Footprint_w / 2 + offset, Corridor_room_1_1_h, Corridor_rooms_1_w, Corridor_room_1_2_h)
        Corridor_room_1_2_p1 = rg.Point3d(Corridor_room_1_1_h,Footprint_w / 2 + offset,0)
        Corridor_room_1_2_p2 = rg.Point3d(Corridor_room_1_1_h + Corridor_room_1_2_h,Footprint_w / 2 + offset,0)
        Corridor_room_1_2_p3 = rg.Point3d(Corridor_room_1_1_h + Corridor_room_1_2_h,Footprint_w,0)
        Corridor_room_1_2_p4 = rg.Point3d(Corridor_room_1_1_h,Footprint_w,0)
        Bedroom1_geometry = rg.Rectangle3d(plane, Corridor_room_1_2_p1, Corridor_room_1_2_p3)

        #Extracting Side 1 - room 2 info
        Corridor_room_1_2_area_round = round_num_up(Corridor_room_1_2_area, decimals = 2)
        Bedroom1_info = "Area: " + str(Corridor_room_1_2_area_round) + " m2"

        #Side 1 - room 3
        Corridor_room_1_3 = createRoom(Footprint_w / 2 + offset, Corridor_room_1_2_h, Corridor_rooms_1_w, Corridor_room_1_3_h)
        Corridor_room_1_3_p1 = rg.Point3d(Corridor_room_1_1_h + Corridor_room_1_2_h,Footprint_w / 2 + offset,0)
        Corridor_room_1_3_p2 = rg.Point3d(Footprint_h * Corridor_h,Footprint_w / 2 + offset,0)
        Corridor_room_1_3_p3 = rg.Point3d(Footprint_h * Corridor_h,Footprint_w,0)
        Corridor_room_1_3_p4 = rg.Point3d(Corridor_room_1_1_h + Corridor_room_1_2_h,Footprint_w,0)
        Kitchen_geometry = rg.Rectangle3d(plane, Corridor_room_1_3_p1, Corridor_room_1_3_p3)

        #Extracting Side 1 - room 3 info
        Corridor_room_1_3_area_round = round_num_up(Corridor_room_1_3_area, decimals = 2)
        Kitchen_info = "Area: " + str(Corridor_room_1_3_area_round) + " m2"

        #Creating 2 rooms on side 2 of the corridor with min area 12
        Corridor_rooms_2_min_area = 12
        Corridor_rooms_2_w = 0 + (Footprint_w / 2 - offset)
        Corridor_rooms_2_h = Footprint_h * Corridor_h
        Corridor_rooms_2_area = Corridor_rooms_2_w * Corridor_rooms_2_h
        Corridor_room_2_1_area = random.uniform(Corridor_rooms_2_min_area, Corridor_rooms_2_area - Corridor_rooms_2_min_area)
        Corridor_room_2_2_area = Corridor_rooms_2_area - Corridor_room_2_1_area
        Corridor_room_2_1_h = Corridor_room_2_1_area / Corridor_rooms_2_w
        Corridor_room_2_2_h = Corridor_room_2_2_area / Corridor_rooms_2_w

        #Side 2 - room 1
        Corridor_room_2_1 = createRoom(Footprint_w / 2 - offset, 0, Corridor_rooms_2_w, Corridor_room_2_1_h)
        Corridor_room_2_1_p1 = rg.Point3d(0,0,0)
        Corridor_room_2_1_p2 = rg.Point3d(Corridor_room_2_1_h,0,0)
        Corridor_room_2_1_p3 = rg.Point3d(Corridor_room_2_1_h,Corridor_rooms_2_w,0)
        Corridor_room_2_1_p4 = rg.Point3d(0,Corridor_rooms_2_w,0)
        Bedroom2_geometry = rg.Rectangle3d(plane, Corridor_room_2_1_p1, Corridor_room_2_1_p3)

        #Extracting Side 2 - room 1 info
        Corridor_room_2_1_area_round = round_num_up(Corridor_room_2_1_area, decimals = 2)
        Bedroom2_info = "Area: " + str(Corridor_room_2_1_area_round) + " m2"

        #Side 2 - room 2
        Corridor_room_2_2_h = createRoom(Footprint_w / 2 - offset, Corridor_room_2_2_h, Corridor_rooms_2_w, Corridor_room_2_2_h)
        Corridor_room_2_2_p1 = rg.Point3d(Corridor_room_2_1_h,0,0)
        Corridor_room_2_2_p2 = rg.Point3d(Footprint_h * Corridor_h,0,0)
        Corridor_room_2_2_p3 = rg.Point3d(Footprint_h * Corridor_h,Footprint_w / 2 - offset,0)
        Corridor_room_2_2_p4 = rg.Point3d(Corridor_room_2_1_h,Footprint_w / 2 - offset,0)
        Bedroom3_geometry = rg.Rectangle3d(plane, Corridor_room_2_2_p1, Corridor_room_2_2_p3)

        #Extracting Side 2 - room 2 info
        Corridor_room_2_2_area_round = round_num_up(Corridor_room_2_2_area, decimals = 2)
        Bedroom3_info = "Area: " + str(Corridor_room_2_2_area_round) + " m2"



      ########################################
      #Checking if the number of bedrooms is 4
      elif number_round == 4.0:
        out8 = "So you want a house with 4 bedrooms? Well, okay then."
        print(out8)

        #Creating plane for rooms
        origin = rg.Point3d(0,0,0)
        x_axis = rg.Vector3d(1,0,0)
        y_axis = rg.Vector3d(0,1,0)
        plane = rg.Plane(origin, x_axis, y_axis)

        #Creating a footprint with random area between 110 and 140 and random proporortions of sides between 1:1.75 and 1:2.25
        Footprint_area = random.uniform(110, 140)
        Footprint_aspect = random.uniform(1.75, 2.25)
        Footprint_w = math.sqrt(Footprint_area / Footprint_aspect)
        Footprint_h = Footprint_w * Footprint_aspect
        Footprint_create = createRoom(0,0, Footprint_w, Footprint_h)
        Footprint_p1 = rg.Point3d(0,0,0)
        Footprint_p2 = rg.Point3d(0,Footprint_w,0)
        Footprint_p3 = rg.Point3d(Footprint_h,Footprint_w,0)
        Footprint_p4 = rg.Point3d(Footprint_h,0,0)
        Footprint_geometry = rg.Rectangle3d(plane, Footprint_p1, Footprint_p3)

        #Extracting Footprint info
        Footprint_area_round = round_num_up(Footprint_area, decimals = 2)
        Footprint_info = "Area: " + str(Footprint_area_round) + " m2"

        #Creating Corridor in the center of the footprint, tangent to all rooms with 1,2m width
        offset = 0.6
        Corridor_h = random.uniform((Footprint_h - 4.5) / Footprint_h, (Footprint_h - 3.5) / Footprint_h)
        Corridor_p1 = rg.Point3d(0,Footprint_w / 2 - offset,0)
        Corridor_p2 = rg.Point3d(Footprint_h * Corridor_h,Footprint_w / 2 - offset,0)
        Corridor_p3 = rg.Point3d(Footprint_h * Corridor_h,Footprint_w / 2 + offset,0)
        Corridor_p4 = rg.Point3d(0,Footprint_w / 2 + offset,0)
        Corridor_geometry = rg.Rectangle3d(plane, Corridor_p1, Corridor_p3)

        #Extracting Corridor info
        Corridor_area = 1.2 * Footprint_h * Corridor_h
        Corridor_area_round = round_num_up(Corridor_area, decimals = 2)
        Corridor_info = "Area: " + str(Corridor_area_round) + " m2"

        #Creating Living room as the biggest room at the end of the corridor
        Corridor_h_rest = 1 - Corridor_h
        Living_create = createRoom(0, Footprint_h * Corridor_h, Footprint_w, Footprint_h * Corridor_h_rest)
        Living_p1 = rg.Point3d(Footprint_h * Corridor_h,0,0)
        Living_p2 = rg.Point3d(Footprint_h,0,0)
        Living_p3 = rg.Point3d(Footprint_h,Footprint_w,0)
        Living_p4 = rg.Point3d(Footprint_h * Corridor_h,Footprint_w,0)
        Living_geometry = rg.Rectangle3d(plane, Living_p1, Living_p3)

        #Extracting Living room info
        Living_area = Footprint_w * Footprint_h * Corridor_h_rest
        Living_area_round = round_num_up(Living_area, decimals = 2)
        Living_info = "Area: " + str(Living_area_round) + " m2"

        #Creating 4 rooms on side 1 of the corridor with min area 8
        Corridor_rooms_1_min_area = 8
        Corridor_rooms_1_w = Footprint_w - (Footprint_w / 2 + offset)
        Corridor_rooms_1_h = Footprint_h * Corridor_h
        Corridor_rooms_1_area = Corridor_rooms_1_w * Corridor_rooms_1_h
        Corridor_room_1_1_area = random.uniform(Corridor_rooms_1_min_area, Corridor_rooms_1_area - (Corridor_rooms_1_min_area * 3))
        Corridor_room_1_2_area = random.uniform(Corridor_rooms_1_min_area, Corridor_rooms_1_area - Corridor_room_1_1_area - (Corridor_rooms_1_min_area * 2))
        Corridor_room_1_3_area = random.uniform(Corridor_rooms_1_min_area, Corridor_rooms_1_area - Corridor_room_1_1_area - Corridor_room_1_2_area - Corridor_rooms_1_min_area)
        Corridor_room_1_4_area = Corridor_rooms_1_area - Corridor_room_1_1_area - Corridor_room_1_2_area - Corridor_room_1_3_area
        Corridor_room_1_1_h = Corridor_room_1_1_area / Corridor_rooms_1_w
        Corridor_room_1_2_h = Corridor_room_1_2_area / Corridor_rooms_1_w
        Corridor_room_1_3_h = Corridor_room_1_3_area / Corridor_rooms_1_w
        Corridor_room_1_4_h = Corridor_room_1_4_area / Corridor_rooms_1_w

        #Side 1 - room 1
        Corridor_room_1_1 = createRoom(Footprint_w / 2 + offset, 0, Corridor_rooms_1_w, Corridor_room_1_1_h)
        Corridor_room_1_1_p1 = rg.Point3d(0,Footprint_w / 2 + offset,0)
        Corridor_room_1_1_p2 = rg.Point3d(Corridor_room_1_1_h,Footprint_w / 2 + offset,0)
        Corridor_room_1_1_p3 = rg.Point3d(Corridor_room_1_1_h,Footprint_w,0)
        Corridor_room_1_1_p4 = rg.Point3d(0,Footprint_w,0)
        Bathroom1_geometry = rg.Rectangle3d(plane, Corridor_room_1_1_p1, Corridor_room_1_1_p3)

        #Extracting Side 1 - room 1 info
        Corridor_room_1_1_area_round = round_num_up(Corridor_room_1_1_area, decimals = 2)
        Bathroom1_info = "Area: " + str(Corridor_room_1_1_area_round) + " m2"

        #Side 1 - room 2
        Corridor_room_1_2 = createRoom(Footprint_w / 2 + offset, Corridor_room_1_1_h, Corridor_rooms_1_w, Corridor_room_1_2_h)
        Corridor_room_1_2_p1 = rg.Point3d(Corridor_room_1_1_h,Footprint_w / 2 + offset,0)
        Corridor_room_1_2_p2 = rg.Point3d(Corridor_room_1_1_h + Corridor_room_1_2_h,Footprint_w / 2 + offset,0)
        Corridor_room_1_2_p3 = rg.Point3d(Corridor_room_1_1_h + Corridor_room_1_2_h,Footprint_w,0)
        Corridor_room_1_2_p4 = rg.Point3d(Corridor_room_1_1_h,Footprint_w,0)
        Bathroom2_geometry = rg.Rectangle3d(plane, Corridor_room_1_2_p1, Corridor_room_1_2_p3)

        #Extracting Side 1 - room 2 info
        Corridor_room_1_2_area_round = round_num_up(Corridor_room_1_2_area, decimals = 2)
        Bathroom2_info = "Area: " + str(Corridor_room_1_2_area_round) + " m2"

        #Side 1 - room 3
        Corridor_room_1_3 = createRoom(Footprint_w / 2 + offset, Corridor_room_1_2_h, Corridor_rooms_1_w, Corridor_room_1_3_h)
        Corridor_room_1_3_p1 = rg.Point3d(Corridor_room_1_1_h + Corridor_room_1_2_h,Footprint_w / 2 + offset,0)
        Corridor_room_1_3_p2 = rg.Point3d(Corridor_room_1_1_h + Corridor_room_1_2_h + Corridor_room_1_3_h,Footprint_w / 2 + offset,0)
        Corridor_room_1_3_p3 = rg.Point3d(Corridor_room_1_1_h + Corridor_room_1_2_h + Corridor_room_1_3_h,Footprint_w,0)
        Corridor_room_1_3_p4 = rg.Point3d(Corridor_room_1_1_h + Corridor_room_1_2_h,Footprint_w,0)
        Bedroom1_geometry = rg.Rectangle3d(plane, Corridor_room_1_3_p1, Corridor_room_1_3_p3)

        #Extracting Side 1 - room 3 info
        Corridor_room_1_3_area_round = round_num_up(Corridor_room_1_3_area, decimals = 2)
        Bedroom1_info = "Area: " + str(Corridor_room_1_3_area_round) + " m2"

        #Side 1 - room 4
        Corridor_room_1_4 = createRoom(Footprint_w / 2 + offset, Corridor_room_1_3_h, Corridor_rooms_1_w, Corridor_room_1_4_h)
        Corridor_room_1_4_p1 = rg.Point3d(Corridor_room_1_1_h + Corridor_room_1_2_h + Corridor_room_1_3_h,Footprint_w / 2 + offset,0)
        Corridor_room_1_4_p2 = rg.Point3d(Footprint_h * Corridor_h,Footprint_w / 2 + offset,0)
        Corridor_room_1_4_p3 = rg.Point3d(Footprint_h * Corridor_h,Footprint_w,0)
        Corridor_room_1_4_p4 = rg.Point3d(Corridor_room_1_1_h + Corridor_room_1_2_h + Corridor_room_1_3_h,Footprint_w,0)
        Kitchen_geometry = rg.Rectangle3d(plane, Corridor_room_1_4_p1, Corridor_room_1_4_p3)

        #Extracting Side 1 - room 4 info
        Corridor_room_1_4_area_round = round_num_up(Corridor_room_1_4_area, decimals = 2)
        Kitchen_info = "Area: " + str(Corridor_room_1_4_area_round) + " m2"

        #Creating 3 rooms on side 2 of the corridor with min area 12
        Corridor_rooms_2_min_area = 12
        Corridor_rooms_2_w = Footprint_w - (Footprint_w / 2 - offset)
        Corridor_rooms_2_h = Footprint_h * Corridor_h
        Corridor_rooms_2_area = Corridor_rooms_2_w * Corridor_rooms_2_h
        Corridor_room_2_1_area = random.uniform(Corridor_rooms_2_min_area, Corridor_rooms_2_area - (Corridor_rooms_2_min_area * 2))
        Corridor_room_2_2_area = random.uniform(Corridor_rooms_2_min_area, Corridor_rooms_2_area - Corridor_room_2_1_area - Corridor_rooms_2_min_area)
        Corridor_room_2_3_area = Corridor_rooms_2_area - Corridor_room_2_1_area - Corridor_room_2_2_area
        Corridor_room_2_1_h = Corridor_room_2_1_area / Corridor_rooms_2_w
        Corridor_room_2_2_h = Corridor_room_2_2_area / Corridor_rooms_2_w
        Corridor_room_2_3_h = Corridor_room_2_3_area / Corridor_rooms_2_w

        #Side 2 - room 1
        Corridor_room_2_1 = createRoom(Footprint_w / 2 - offset, 0, Corridor_rooms_2_w, Corridor_room_2_1_h)
        Corridor_room_2_1_p1 = rg.Point3d(0,0,0)
        Corridor_room_2_1_p2 = rg.Point3d(Corridor_room_2_1_h,0,0)
        Corridor_room_2_1_p3 = rg.Point3d(Corridor_room_2_1_h,Footprint_w / 2 - offset,0)
        Corridor_room_2_1_p4 = rg.Point3d(0,Footprint_w / 2 - offset,0)
        Bedroom2_geometry = rg.Rectangle3d(plane, Corridor_room_2_1_p1, Corridor_room_2_1_p3)

        #Extracting Side 2 - room 1 info
        Corridor_room_2_1_area_round = round_num_up(Corridor_room_2_1_area, decimals = 2)
        Bedroom2_info = "Area: " + str(Corridor_room_2_1_area_round) + " m2"

        #Side 2 - room 2
        Corridor_room_2_2 = createRoom(Footprint_w / 2 - offset, Corridor_room_2_1_h, Corridor_rooms_2_w, Corridor_room_2_2_h)
        Corridor_room_2_2_p1 = rg.Point3d(Corridor_room_2_1_h,0,0)
        Corridor_room_2_2_p2 = rg.Point3d(Corridor_room_2_1_h + Corridor_room_2_2_h,0,0)
        Corridor_room_2_2_p3 = rg.Point3d(Corridor_room_2_1_h + Corridor_room_2_2_h,Footprint_w / 2 - offset,0)
        Corridor_room_2_2_p4 = rg.Point3d(Corridor_room_2_1_h,Footprint_w / 2 - offset,0)
        Bedroom3_geometry = rg.Rectangle3d(plane, Corridor_room_2_2_p1, Corridor_room_2_2_p3)

        #Extracting Side 2 - room 2 info
        Corridor_room_2_2_area_round = round_num_up(Corridor_room_2_2_area, decimals = 2)
        Bedroom3_info = "Area: " + str(Corridor_room_2_2_area_round) + " m2"

        #Side 2 - room 3
        Corridor_room_2_3 = createRoom(Footprint_w / 2 - offset, Corridor_room_2_2_h, Corridor_rooms_2_w, Corridor_room_2_3_h)
        Corridor_room_2_3_p1 = rg.Point3d(Corridor_room_2_1_h + Corridor_room_2_2_h,0,0)
        Corridor_room_2_3_p2 = rg.Point3d(Footprint_h * Corridor_h,0,0)
        Corridor_room_2_3_p3 = rg.Point3d(Footprint_h * Corridor_h,Footprint_w / 2 - offset,0)
        Corridor_room_2_3_p4 = rg.Point3d(Corridor_room_2_1_h + Corridor_room_2_2_h,Footprint_w / 2 - offset,0)
        Bedroom4_geometry = rg.Rectangle3d(plane, Corridor_room_2_3_p1, Corridor_room_2_3_p3)

        #Extracting Side 2 - room 3 info
        Corridor_room_2_3_area_round = round_num_up(Corridor_room_2_3_area, decimals = 2)
        Bedroom4_info = "Area: " + str(Corridor_room_2_3_area_round) + " m2"



      ########################################
      #Checking if the number of bedrooms is 5
      elif number_round == 5.0:
        out9 = "So you want a house with 5 bedrooms? Well, okay then."
        print(out9)

        #Creating plane for rooms
        origin = rg.Point3d(0,0,0)
        x_axis = rg.Vector3d(1,0,0)
        y_axis = rg.Vector3d(0,1,0)
        plane = rg.Plane(origin, x_axis, y_axis)

        #Creating a footprint with random area between 130 and 180 and random proporortions of sides between 1:1.8 and 1:2.3
        Footprint_area = random.uniform(130, 180)
        Footprint_aspect = random.uniform(1.8, 2.3)
        Footprint_w = math.sqrt(Footprint_area / Footprint_aspect)
        Footprint_h = Footprint_w * Footprint_aspect
        Footprint_create = createRoom(0,0, Footprint_w, Footprint_h)
        Footprint_p1 = rg.Point3d(0,0,0)
        Footprint_p2 = rg.Point3d(0,Footprint_w,0)
        Footprint_p3 = rg.Point3d(Footprint_h,Footprint_w,0)
        Footprint_p4 = rg.Point3d(Footprint_h,0,0)
        Footprint_geometry = rg.Rectangle3d(plane, Footprint_p1, Footprint_p3)

        #Extracting Footprint info
        Footprint_area_round = round_num_up(Footprint_area, decimals = 2)
        Footprint_info = "Area: " + str(Footprint_area_round) + " m2"

        #Creating Corridor in the center of the footprint, tangent to all rooms with 1,2m width
        offset = 0.6
        Corridor_h = random.uniform((Footprint_h - 4.5) / Footprint_h, (Footprint_h - 3.5) / Footprint_h)
        Corridor_p1 = rg.Point3d(0,Footprint_w / 2 - offset,0)
        Corridor_p2 = rg.Point3d(Footprint_h * Corridor_h,Footprint_w / 2 - offset,0)
        Corridor_p3 = rg.Point3d(Footprint_h * Corridor_h,Footprint_w / 2 + offset,0)
        Corridor_p4 = rg.Point3d(0,Footprint_w / 2 + offset,0)
        Corridor_geometry = rg.Rectangle3d(plane, Corridor_p1, Corridor_p3)

        #Extracting Corridor info
        Corridor_area = 1.2 * Footprint_h * Corridor_h
        Corridor_area_round = round_num_up(Corridor_area, decimals = 2)
        Corridor_info = "Area: " + str(Corridor_area_round) + " m2"

        #Creating Living room as the biggest room at the end of the corridor
        Corridor_h_rest = 1 - Corridor_h
        Living_create = createRoom(0, Footprint_h * Corridor_h, Footprint_w, Footprint_h * Corridor_h_rest)
        Living_p1 = rg.Point3d(Footprint_h * Corridor_h,0,0)
        Living_p2 = rg.Point3d(Footprint_h,0,0)
        Living_p3 = rg.Point3d(Footprint_h,Footprint_w,0)
        Living_p4 = rg.Point3d(Footprint_h * Corridor_h,Footprint_w,0)
        Living_geometry = rg.Rectangle3d(plane, Living_p1, Living_p3)

        #Extracting Living room info
        Living_area = Footprint_w * Footprint_h * Corridor_h_rest
        Living_area_round = round_num_up(Living_area, decimals = 2)
        Living_info = "Area: " + str(Living_area_round) + " m2"

        #Creating 4 rooms on side 1 of the corridor with min area 10
        Corridor_rooms_1_min_area = 10
        Corridor_rooms_1_w = Footprint_w - (Footprint_w / 2 + offset)
        Corridor_rooms_1_h = Footprint_h * Corridor_h
        Corridor_rooms_1_area = Corridor_rooms_1_w * Corridor_rooms_1_h
        Corridor_room_1_1_area = random.uniform(Corridor_rooms_1_min_area, Corridor_rooms_1_area - (Corridor_rooms_1_min_area * 3))
        Corridor_room_1_2_area = random.uniform(Corridor_rooms_1_min_area, Corridor_rooms_1_area - Corridor_room_1_1_area - (Corridor_rooms_1_min_area * 2))
        Corridor_room_1_3_area = random.uniform(Corridor_rooms_1_min_area, Corridor_rooms_1_area - Corridor_room_1_1_area - Corridor_room_1_2_area - Corridor_rooms_1_min_area)
        Corridor_room_1_4_area = Corridor_rooms_1_area - Corridor_room_1_1_area - Corridor_room_1_2_area - Corridor_room_1_3_area
        Corridor_room_1_1_h = Corridor_room_1_1_area / Corridor_rooms_1_w
        Corridor_room_1_2_h = Corridor_room_1_2_area / Corridor_rooms_1_w
        Corridor_room_1_3_h = Corridor_room_1_3_area / Corridor_rooms_1_w
        Corridor_room_1_4_h = Corridor_room_1_4_area / Corridor_rooms_1_w

        #Side 1 - room 1
        Corridor_room_1_1 = createRoom(Footprint_w / 2 + offset, 0, Corridor_rooms_1_w, Corridor_room_1_1_h)
        Corridor_room_1_1_p1 = rg.Point3d(0,Footprint_w / 2 + offset,0)
        Corridor_room_1_1_p2 = rg.Point3d(Corridor_room_1_1_h,Footprint_w / 2 + offset,0)
        Corridor_room_1_1_p3 = rg.Point3d(Corridor_room_1_1_h,Footprint_w,0)
        Corridor_room_1_1_p4 = rg.Point3d(0,Footprint_w,0)
        Bathroom1_geometry = rg.Rectangle3d(plane, Corridor_room_1_1_p1, Corridor_room_1_1_p3)

        #Extracting Side 1 - room 1 info
        Corridor_room_1_1_area_round = round_num_up(Corridor_room_1_1_area, decimals = 2)
        Bathroom1_info = "Area: " + str(Corridor_room_1_1_area_round) + " m2"

        #Side 1 - room 2
        Corridor_room_1_2 = createRoom(Footprint_w / 2 + offset, Corridor_room_1_1_h, Corridor_rooms_1_w, Corridor_room_1_2_h)
        Corridor_room_1_2_p1 = rg.Point3d(Corridor_room_1_1_h,Footprint_w / 2 + offset,0)
        Corridor_room_1_2_p2 = rg.Point3d(Corridor_room_1_1_h + Corridor_room_1_2_h,Footprint_w / 2 + offset,0)
        Corridor_room_1_2_p3 = rg.Point3d(Corridor_room_1_1_h + Corridor_room_1_2_h,Footprint_w,0)
        Corridor_room_1_2_p4 = rg.Point3d(Corridor_room_1_1_h,Footprint_w,0)
        Bathroom2_geometry = rg.Rectangle3d(plane, Corridor_room_1_2_p1, Corridor_room_1_2_p3)

        #Extracting Side 1 - room 2 info
        Corridor_room_1_2_area_round = round_num_up(Corridor_room_1_2_area, decimals = 2)
        Bathroom2_info = "Area: " + str(Corridor_room_1_2_area_round) + " m2"

        #Side 1 - room 3
        Corridor_room_1_3 = createRoom(Footprint_w / 2 + offset, Corridor_room_1_2_h, Corridor_rooms_1_w, Corridor_room_1_3_h)
        Corridor_room_1_3_p1 = rg.Point3d(Corridor_room_1_1_h + Corridor_room_1_2_h,Footprint_w / 2 + offset,0)
        Corridor_room_1_3_p2 = rg.Point3d(Corridor_room_1_1_h + Corridor_room_1_2_h + Corridor_room_1_3_h,Footprint_w / 2 + offset,0)
        Corridor_room_1_3_p3 = rg.Point3d(Corridor_room_1_1_h + Corridor_room_1_2_h + Corridor_room_1_3_h,Footprint_w,0)
        Corridor_room_1_3_p4 = rg.Point3d(Corridor_room_1_1_h + Corridor_room_1_2_h,Footprint_w,0)
        Bedroom1_geometry = rg.Rectangle3d(plane, Corridor_room_1_3_p1, Corridor_room_1_3_p3)

        #Extracting Side 1 - room 3 info
        Corridor_room_1_3_area_round = round_num_up(Corridor_room_1_3_area, decimals = 2)
        Bedroom1_info = "Area: " + str(Corridor_room_1_3_area_round) + " m2"

        #Side 1 - room 4
        Corridor_room_1_4 = createRoom(Footprint_w / 2 + offset, Corridor_room_1_3_h, Corridor_rooms_1_w, Corridor_room_1_4_h)
        Corridor_room_1_4_p1 = rg.Point3d(Corridor_room_1_1_h + Corridor_room_1_2_h + Corridor_room_1_3_h,Footprint_w / 2 + offset,0)
        Corridor_room_1_4_p2 = rg.Point3d(Footprint_h * Corridor_h,Footprint_w / 2 + offset,0)
        Corridor_room_1_4_p3 = rg.Point3d(Footprint_h * Corridor_h,Footprint_w,0)
        Corridor_room_1_4_p4 = rg.Point3d(Corridor_room_1_1_h + Corridor_room_1_2_h + Corridor_room_1_3_h,Footprint_w,0)
        Kitchen_geometry = rg.Rectangle3d(plane, Corridor_room_1_4_p1, Corridor_room_1_4_p3)

        #Extracting Side 1 - room 4 info
        Corridor_room_1_4_area_round = round_num_up(Corridor_room_1_4_area, decimals = 2)
        Kitchen_info = "Area: " + str(Corridor_room_1_4_area_round) + " m2"

        #Creating 4 rooms on side 2 of the corridor with min area 12
        Corridor_rooms_2_min_area = 12
        Corridor_rooms_2_w = Footprint_w - (Footprint_w / 2 - offset)
        Corridor_rooms_2_h = Footprint_h * Corridor_h
        Corridor_rooms_2_area = Corridor_rooms_2_w * Corridor_rooms_2_h
        Corridor_room_2_1_area = random.uniform(Corridor_rooms_2_min_area, Corridor_rooms_2_area - (Corridor_rooms_2_min_area * 3))
        Corridor_room_2_2_area = random.uniform(Corridor_rooms_2_min_area, Corridor_rooms_2_area - Corridor_room_2_1_area - (Corridor_rooms_2_min_area * 2))
        Corridor_room_2_3_area = random.uniform(Corridor_rooms_2_min_area, Corridor_rooms_2_area - Corridor_room_2_1_area - Corridor_room_2_2_area - Corridor_rooms_2_min_area )
        Corridor_room_2_4_area = Corridor_rooms_2_area - Corridor_room_2_1_area - Corridor_room_2_2_area - Corridor_room_2_3_area
        Corridor_room_2_1_h = Corridor_room_2_1_area / Corridor_rooms_2_w
        Corridor_room_2_2_h = Corridor_room_2_2_area / Corridor_rooms_2_w
        Corridor_room_2_3_h = Corridor_room_2_3_area / Corridor_rooms_2_w
        Corridor_room_2_4_h = Corridor_room_2_4_area / Corridor_rooms_2_w

        #Side 2 - room 1
        Corridor_room_2_1 = createRoom(Footprint_w / 2 - offset, 0, Corridor_rooms_2_w, Corridor_room_2_1_h)
        Corridor_room_2_1_p1 = rg.Point3d(0,0,0)
        Corridor_room_2_1_p2 = rg.Point3d(Corridor_room_2_1_h,0,0)
        Corridor_room_2_1_p3 = rg.Point3d(Corridor_room_2_1_h,Footprint_w / 2 - offset,0)
        Corridor_room_2_1_p4 = rg.Point3d(0,Footprint_w / 2 - offset,0)
        Bedroom2_geometry = rg.Rectangle3d(plane, Corridor_room_2_1_p1, Corridor_room_2_1_p3)

        #Extracting Side 2 - room 1 info
        Corridor_room_2_1_area_round = round_num_up(Corridor_room_2_1_area, decimals = 2)
        Bedroom2_info = "Area: " + str(Corridor_room_2_1_area_round) + " m2"

        #Side 2 - room 2
        Corridor_room_2_2 = createRoom(Footprint_w / 2 - offset, Corridor_room_2_1_h, Corridor_rooms_2_w, Corridor_room_2_2_h)
        Corridor_room_2_2_p1 = rg.Point3d(Corridor_room_2_1_h,0,0)
        Corridor_room_2_2_p2 = rg.Point3d(Corridor_room_2_1_h + Corridor_room_2_2_h,0,0)
        Corridor_room_2_2_p3 = rg.Point3d(Corridor_room_2_1_h + Corridor_room_2_2_h,Footprint_w / 2 - offset,0)
        Corridor_room_2_2_p4 = rg.Point3d(Corridor_room_2_1_h,Footprint_w / 2 - offset,0)
        Bedroom3_geometry = rg.Rectangle3d(plane, Corridor_room_2_2_p1, Corridor_room_2_2_p3)

        #Extracting Side 2 - room 2 info
        Corridor_room_2_2_area_round = round_num_up(Corridor_room_2_2_area, decimals = 2)
        Bedroom3_info = "Area: " + str(Corridor_room_2_2_area_round) + " m2"

        #Side 2 - room 3
        Corridor_room_2_3 = createRoom(Footprint_w / 2 - offset, Corridor_room_2_2_h, Corridor_rooms_2_w, Corridor_room_2_3_h)
        Corridor_room_2_3_p1 = rg.Point3d(Corridor_room_2_1_h + Corridor_room_2_2_h,0,0)
        Corridor_room_2_3_p2 = rg.Point3d(Corridor_room_2_1_h + Corridor_room_2_2_h + Corridor_room_2_3_h,0,0)
        Corridor_room_2_3_p3 = rg.Point3d(Corridor_room_2_1_h + Corridor_room_2_2_h + Corridor_room_2_3_h,Footprint_w / 2 - offset,0)
        Corridor_room_2_3_p4 = rg.Point3d(Corridor_room_2_1_h + Corridor_room_2_2_h,Footprint_w / 2 - offset,0)
        Bedroom4_geometry = rg.Rectangle3d(plane, Corridor_room_2_3_p1, Corridor_room_2_3_p3)

        #Extracting Side 2 - room 3 info
        Corridor_room_2_3_area_round = round_num_up(Corridor_room_2_3_area, decimals = 2)
        Bedroom4_info = "Area: " + str(Corridor_room_2_3_area_round) + " m2"

        #Side 2 - room 4
        Corridor_room_2_4 = createRoom(Footprint_w / 2 - offset, Corridor_room_2_3_h, Corridor_rooms_2_w, Corridor_room_2_4_h)
        Corridor_room_2_4_p1 = rg.Point3d(Corridor_room_2_1_h + Corridor_room_2_2_h + Corridor_room_2_3_h,0,0)
        Corridor_room_2_4_p2 = rg.Point3d(Footprint_h * Corridor_h,0,0)
        Corridor_room_2_4_p3 = rg.Point3d(Footprint_h * Corridor_h,Footprint_w / 2 - offset,0)
        Corridor_room_2_4_p4 = rg.Point3d(Corridor_room_2_1_h + Corridor_room_2_2_h + Corridor_room_2_3_h,Footprint_w / 2 - offset,0)
        Bedroom5_geometry = rg.Rectangle3d(plane, Corridor_room_2_4_p1, Corridor_room_2_4_p3)

        #Extracting Side 2 - room 4 info
        Corridor_room_2_4_area_round = round_num_up(Corridor_room_2_4_area, decimals = 2)
        Bedroom5_info = "Area: " + str(Corridor_room_2_4_area_round) + " m2"



  else:
    #If the text doesn't start with a word "Generate" or does not contain a word "house" and "bedrooms"
    out2 = "Text does not start with 'Generate' or does not contain 'house' and 'bedrooms' so no geometry have been created."
    print(out2)



else:
  #If the text doesn't start with a word "Generate" or does not contain a word "house" and "bedrooms"
  out1 = "Text does not start with 'Generate' or does not contain 'house' and 'bedrooms' so no geometry have been created."
  print(out1)
# ---------- end ghpython_script ----------
# NEXT STEPS: The created geometry can be exported and assigned BIM attributes by means of any adequate software, e.g. Speckle.
panel = Panel(ghpython_script.out)

# ---- group: Footprint
panel_2 = Panel(ghpython_script.Footprint_info)
curve = Curve(ghpython_script.Footprint_geometry)

# ---- group: Corridor
panel_3 = Panel(ghpython_script.Corridor_info)
curve_2 = Curve(ghpython_script.Corridor_geometry)

# ---- group: Bathroom1
panel_4 = Panel(ghpython_script.Bathroom1_info)
curve_3 = Curve(ghpython_script.Bathroom1_geometry)

# ---- group: Bedroom2
panel_5 = Panel(ghpython_script.Bedroom2_info)
curve_4 = Curve(ghpython_script.Bedroom2_geometry)

# ---- group: Bedroom3
panel_6 = Panel(ghpython_script.Bedroom3_info)
curve_5 = Curve(ghpython_script.Bedroom3_geometry)

# ---- group: Bedroom4
panel_7 = Panel(ghpython_script.Bedroom4_info)
curve_6 = Curve(ghpython_script.Bedroom4_geometry)

# ---- group: Living room
panel_8 = Panel(ghpython_script.Living_info)
curve_7 = Curve(ghpython_script.Living_geometry)

# ---- group: Kitchen
panel_9 = Panel(ghpython_script.Kitchen_info)
curve_8 = Curve(ghpython_script.Kitchen_geometry)

# ---- group: Bathroom2
panel_10 = Panel(ghpython_script.Bathroom2_info)
curve_9 = Curve(ghpython_script.Bathroom2_geometry)

# ---- group: Bedroom1
panel_11 = Panel(ghpython_script.Bedroom1_info)
curve_10 = Curve(ghpython_script.Bedroom1_geometry)

# ---- group: Bedroom5
panel_12 = Panel(ghpython_script.Bedroom5_info)
curve_11 = Curve(ghpython_script.Bedroom5_geometry)

# ---- group: Basic room tag for visualization purposes
area = Area(Geometry=curve_2)  # -> Area, Centroid
text_tag = TextTag(Location=area.Centroid, Text=panel_3)

area_2 = Area(Geometry=curve_7)  # -> Area, Centroid
text_tag_2 = TextTag(Location=area_2.Centroid, Text=panel_8)

area_3 = Area(Geometry=curve_8)  # -> Area, Centroid
text_tag_3 = TextTag(Location=area_3.Centroid, Text=panel_9)

# ---- group: Basic walls and roof for visualization purposes / Roof
panel_13 = Panel("4")
unit_z = UnitZ(Factor=panel_13)
move = Move(Geometry=curve, Motion=unit_z)  # -> Geometry, Transform
offset_curve = OffsetCurve(Curve=move.Geometry, Distance="0.9", Corners=1)
explode = Explode(Curve=offset_curve, Recursive=True)  # -> Segments, Vertices
list_item = ListItem(List=explode.Segments, Index=0, Wrap=True)  # -> Item, Item1, Item2, Item3
point_on_curve = PointOnCurve([list_item.Item1, list_item.Item3], parameter=0.5)
list_item_2 = ListItem(List=point_on_curve, Index=0, Wrap=True)  # -> Item, Item1
panel_14 = Panel("1.5")
line = Line(StartPoint=list_item_2.Item, EndPoint=list_item_2.Item1)
unit_z_2 = UnitZ(Factor=panel_14)
move_2 = Move(Geometry=line, Motion=unit_z_2)  # -> Geometry, Transform
curve_12 = Curve(move_2.Geometry)
curve_13 = Curve(list_item.Item2)
curve_14 = Curve(list_item.Item)
end_points = EndPoints(Curve=curve_12)  # -> Start, End
end_points_2 = EndPoints(Curve=curve_14)  # -> Start, End
end_points_3 = EndPoints(Curve=curve_13)  # -> Start, End
line_2 = Line(StartPoint=end_points.Start, EndPoint=end_points_2.End)
line_3 = Line(StartPoint=end_points.End, EndPoint=end_points_2.Start)
line_4 = Line(StartPoint=end_points.Start, EndPoint=end_points_3.Start)
line_5 = Line(StartPoint=end_points.End, EndPoint=end_points_3.End)
join_curves = JoinCurves(Curves=[line_2, line_3, curve_14, curve_12], Preserve=False)
join_curves_2 = JoinCurves(Curves=[line_4, line_5, curve_13, curve_12], Preserve=False)
unit_z_3 = UnitZ(Factor="0.3")
surface = Surface(join_curves)
surface_2 = Surface(join_curves_2)
extrude = Extrude(Base=surface, Direction=unit_z_3)
extrude_2 = Extrude(Base=join_curves_2, Direction=unit_z_3)
cap_holes = CapHoles(Brep=extrude)
cap_holes_2 = CapHoles(Brep=extrude_2)
deconstruct_brep = DeconstructBrep(Brep=[cap_holes, cap_holes_2])  # -> Faces, Edges, Vertices
curve_15 = Curve(deconstruct_brep.Edges)

# ---- group: Basic room tag for visualization purposes
area_4 = Area(Geometry=curve_3)  # -> Area, Centroid
text_tag_4 = TextTag(Location=area_4.Centroid, Text=panel_4)

area_5 = Area(Geometry=curve_9)  # -> Area, Centroid
text_tag_5 = TextTag(Location=area_5.Centroid, Text=panel_10)

area_6 = Area(Geometry=curve_10)  # -> Area, Centroid
text_tag_6 = TextTag(Location=area_6.Centroid, Text=panel_11)

area_7 = Area(Geometry=curve_4)  # -> Area, Centroid
text_tag_7 = TextTag(Location=area_7.Centroid, Text=panel_5)

area_8 = Area(Geometry=curve_5)  # -> Area, Centroid
text_tag_8 = TextTag(Location=area_8.Centroid, Text=panel_6)

area_9 = Area(Geometry=curve_6)  # -> Area, Centroid
text_tag_9 = TextTag(Location=area_9.Centroid, Text=panel_7)

area_10 = Area(Geometry=curve_11)  # -> Area, Centroid
text_tag_10 = TextTag(Location=area_10.Centroid, Text=panel_12)

# ---- group: Basic walls and roof for visualization purposes / Walls
offset_curve_2 = OffsetCurve(Curve=curve, Distance="0.35", Corners=1)
addition = Addition(A=panel_13, B=panel_14)
addition_2 = Addition(A=panel_13, B=panel_14)
unit_z_4 = UnitZ(Factor=addition)
unit_z_5 = UnitZ(Factor=addition_2)
extrude_3 = Extrude(Base=offset_curve_2, Direction=unit_z_4)
extrude_4 = Extrude(Base=curve, Direction=unit_z_5)
cap_holes_3 = CapHoles(Brep=extrude_3)
cap_holes_4 = CapHoles(Brep=extrude_4)
solid_difference = SolidDifference(BrepsA=cap_holes_3, BrepsB=cap_holes_4)
solid_union = SolidUnion(Breps=[cap_holes, cap_holes_2])
solid_difference_2 = SolidDifference(BrepsA=solid_difference, BrepsB=solid_union)
list_item_3 = ListItem(List=solid_difference_2, Index=1, Wrap=True)  # -> Item, Item1, Item2
brep = Brep(list_item_3.Item)
deconstruct_brep_2 = DeconstructBrep(Brep=brep)  # -> Faces, Edges, Vertices
curve_16 = Curve(deconstruct_brep_2.Edges)
